# Grasshopper definition Fabrication-Grammars-Interaction-Modes.gh (Grasshopper 1.0.7)
# plug-ins: MqttTools, KUKA|crc - cloud remote control, KUKA|prc - parametric robot control, KUKA|crc - Addon Library

# ---- group: Retrieves data using input as ID
python = GhPythonScript(desired_id=Slider(2, range=0..100))  # -> out, OutputData; inputs desired_id: list of Int32
# ---------- python: Python ----------
import sqlite3
import json
import Rhino.Geometry as rg

# Connect to the SQLite database
conn = sqlite3.connect(r"D:\Courses\Python projects\Robotic Fabrication Database\Intermediate pln\plane.db")
c = conn.cursor()

# Specify the table name and column name
table_name = 'robot_data'
column_name = 'intermediate_pln'

# Check if desired_id is a single numeric value
if isinstance(desired_id, (int, float)):
    my_id = int(desired_id)
else:
    # If it's a list, take the first element
    if isinstance(desired_id, list) and len(desired_id) > 0:
        my_id = int(desired_id[0])
    else:
        print("Error: desired_id must be a single numeric value.")
        conn.close()
        exit()

try:
    # Retrieve the JSON-formatted data from the database based on the specified ID
    c.execute("SELECT {} FROM {} WHERE id = ?".format(column_name, table_name), (my_id,))
    row = c.fetchone()

    if row:
        all_plane_data_json = row[0]

        # Convert JSON to Python objects
        plane_data_list = json.loads(all_plane_data_json)

        # Format data for Grasshopper
        grasshopper_format_data = []
        for plane_dict in plane_data_list:
            origin = rg.Point3d(plane_dict['Origin'][0], plane_dict['Origin'][1], plane_dict['Origin'][2])
            x_axis = rg.Vector3d(plane_dict['XAxis'][0], plane_dict['XAxis'][1], plane_dict['XAxis'][2])
            y_axis = rg.Vector3d(plane_dict['YAxis'][0], plane_dict['YAxis'][1], plane_dict['YAxis'][2])
            z_axis = rg.Vector3d(plane_dict['ZAxis'][0], plane_dict['ZAxis'][1], plane_dict['ZAxis'][2])

            plane = rg.Plane(origin, x_axis, y_axis)
            grasshopper_format_data.append(plane)

        # Output the data to Grasshopper (assuming Grasshopper has an output variable named 'OutputData')
        OutputData = grasshopper_format_data
        print("Data retrieved successfully.")
    else:
        print("No data found in the database for ID: {}".format(my_id))
except sqlite3.Error as e:
    print("Error retrieving data: {}".format(e))

# Close the connection
conn.close()
# ---------- end python ----------

# ----
panel = Panel(python.OutputData)

# ---- group: Retrieves data successfully from database
# Uses the insert or replace instead of update
python_2 = GhPythonScript()  # -> out, OutputData; inputs x: Plane
# ---------- python_2: Python ----------
import sqlite3
import json
import Rhino.Geometry as rg

# Connect to the SQLite database
conn = sqlite3.connect(r"D:\Courses\Python projects\Robotic Fabrication Database\Intermediate pln\plane.db")
c = conn.cursor()

# Specify the table name and column name
table_name = 'robot_data'
column_name = 'intermediate_pln'

# Specify the desired ID
desired_id = 11  # Change this to the ID you want to retrieve

try:
    # Retrieve the JSON-formatted data from the database based on the specified ID
    c.execute("SELECT {} FROM {} WHERE id = ?".format(column_name, table_name), (desired_id,))
    row = c.fetchone()
    
    if row:
        all_plane_data_json = row[0]

        # Convert JSON to Python objects
        plane_data_list = json.loads(all_plane_data_json)

        # Format data for Grasshopper
        grasshopper_format_data = []
        for plane_dict in plane_data_list:
            origin = rg.Point3d(plane_dict['Origin'][0], plane_dict['Origin'][1], plane_dict['Origin'][2])
            x_axis = rg.Vector3d(plane_dict['XAxis'][0], plane_dict['XAxis'][1], plane_dict['XAxis'][2])
            y_axis = rg.Vector3d(plane_dict['YAxis'][0], plane_dict['YAxis'][1], plane_dict['YAxis'][2])
            z_axis = rg.Vector3d(plane_dict['ZAxis'][0], plane_dict['ZAxis'][1], plane_dict['ZAxis'][2])

            plane = rg.Plane(origin, x_axis, y_axis)
            grasshopper_format_data.append(plane)

        # Output the data to Grasshopper (assuming Grasshopper has an output variable named 'OutputData')
        OutputData = grasshopper_format_data
        print("Data retrieved successfully.")
    else:
        print("No data found in the database for ID: {}".format(desired_id))
except sqlite3.Error as e:
    print("Error retrieving data: {}".format(e))

# Close the connection
conn.close()
# ---------- end python_2 ----------
panel_2 = Panel(python_2.OutputData)

# ---- group: Database with just intermediate_PLNS
python_3 = GhPythonScript()  # -> out, a; inputs Intermediate_PLNS: list of Plane
# ---------- python_3: Python ----------
import sqlite3
import json
import Rhino.Geometry as rg

# Assuming Intermediate_PLNS is a Grasshopper input variable
# Access the data directly from the Grasshopper input
data_list = Intermediate_PLNS

# Connect to the SQLite database
conn = sqlite3.connect(r"D:\Courses\Python projects\Robotic Fabrication Database\Intermediate pln\plane.db")
c = conn.cursor()

# Specify the table name and column name
table_name = 'robot_data'
column_name = 'intermediate_pln'

# Create a list to store plane data dictionaries
plane_data_list = []

# Iterate over the plane data and create dictionaries
for i, data in enumerate(data_list):
    if isinstance(data, rg.Plane):
        plane_dict = {
            'Origin': [data.OriginX, data.OriginY, data.OriginZ],
            'XAxis': [data.XAxis.X, data.XAxis.Y, data.XAxis.Z],
            'YAxis': [data.YAxis.X, data.YAxis.Y, data.YAxis.Z],
            'ZAxis': [data.ZAxis.X, data.ZAxis.Y, data.ZAxis.Z]
        }
        plane_data_list.append(plane_dict)

# Convert the list of dictionaries to a JSON string
all_plane_data_json = json.dumps(plane_data_list)

try:
    # Update the database with the concatenated plane data
    c.execute('''
        INSERT OR REPLACE INTO {} (id, {}) 
        VALUES (?, ?)
    '''.format(table_name, column_name), (1, all_plane_data_json))
    print("Row updated successfully.")
except sqlite3.Error as e:
    print("Error updating row: {}".format(e))

# Commit changes and close the connection
conn.commit()
conn.close()
# ---------- end python_3 ----------

# ---- group: Updates the JSON as 1 row
python_4 = GhPythonScript()  # -> out, a; inputs Intermediate_PLNS: list of Plane
# ---------- python_4: Python ----------
import sqlite3
import json
import Rhino.Geometry as rg

# Assuming Intermediate_PLNS is a Grasshopper input variable
# Access the data directly from the Grasshopper input
data_list = Intermediate_PLNS

# Connect to the SQLite database
conn = sqlite3.connect(r'D:\Courses\Python projects\Robotic Fabrication Database\Robotic Fabrication\kuka.db')
c = conn.cursor()

# Specify the table name and column name
table_name = 'robot_data'
column_name = 'label'

# Create a list to store plane data dictionaries
plane_data_list = []

# Iterate over the plane data and create dictionaries
for i, data in enumerate(data_list):
    if isinstance(data, rg.Plane):
        plane_dict = {
            'Origin': [data.OriginX, data.OriginY, data.OriginZ],
            'XAxis': [data.XAxis.X, data.XAxis.Y, data.XAxis.Z],
            'YAxis': [data.YAxis.X, data.YAxis.Y, data.YAxis.Z],
            'ZAxis': [data.ZAxis.X, data.ZAxis.Y, data.ZAxis.Z]
        }
        plane_data_list.append(plane_dict)

# Convert the list of dictionaries to a JSON string
all_plane_data_json = json.dumps(plane_data_list)

try:
    # Update the database with the concatenated plane data
    c.execute('''
        UPDATE {} 
        SET {} = ?
        WHERE rowid = 1
    '''.format(table_name, column_name), (all_plane_data_json,))
    print("Row updated successfully.")
except sqlite3.Error as e:
    print("Error updating row: {}".format(e))

# Commit changes and close the connection
conn.commit()
conn.close()
a = Intermediate_PLNS
# ---------- end python_4 ----------

# ---- group: Without JSON format and sql does not support
python_5 = GhPythonScript()  # -> out, a; inputs Intermediate_PLNS: list of Plane
# ---------- python_5: Python ----------
import sqlite3
import Rhino.Geometry as rg

# Assuming Intermediate_PLNS is a Grasshopper input variable
# Access the data directly from the Grasshopper input
data_list = Intermediate_PLNS

# Connect to the SQLite database
conn = sqlite3.connect(r'D:\Courses\Python projects\Robotic Fabrication Database\Robotic Fabrication\kuka.db')
c = conn.cursor()

# Specify the table name and column name
table_name = 'robot_data'
column_name = 'intermediate_pln'

# Update the database with the plane data
for i, data in enumerate(data_list):
    if isinstance(data, rg.Plane):
        try:
            c.execute('''
                UPDATE {} 
                SET {} = ?
                WHERE rowid = ?
            '''.format(table_name, column_name), (data, i + 1))
            print("Row {} updated successfully.".format(i + 1))
        except sqlite3.Error as e:
            print("Error updating row {}: {}".format(i + 1, e))

# Commit changes and close the connection
conn.commit()
conn.close()
# ---------- end python_5 ----------

# ---- group: Prints successful but does not update
python_6 = GhPythonScript()  # -> out, a; inputs Intermediate_PLNS: list of Plane
# ---------- python_6: Python ----------
import sqlite3
import json
import Rhino.Geometry as rg

# Assuming Intermediate_PLNS is a Grasshopper input variable
# Access the data directly from the Grasshopper input
data_list = Intermediate_PLNS

# Connect to the SQLite database
conn = sqlite3.connect(r'D:\Courses\Python projects\Robotic Fabrication Database\Robotic Fabrication\kuka.db')
c = conn.cursor()

# Specify the table name and column name
table_name = 'robot_data'
column_name = 'intermediate_pln'

# Update the database with the plane data
for i, data in enumerate(data_list):
    if isinstance(data, rg.Plane):
        # Create a dictionary with plane information
        plane_dict = {
            'Origin': [data.OriginX, data.OriginY, data.OriginZ],
            'XAxis': [data.XAxis.X, data.XAxis.Y, data.XAxis.Z],
            'YAxis': [data.YAxis.X, data.YAxis.Y, data.YAxis.Z],
            'ZAxis': [data.ZAxis.X, data.ZAxis.Y, data.ZAxis.Z]
        }

        # Convert the dictionary to a JSON string
        plane_data_json = json.dumps(plane_dict)

        try:
            c.execute('''
                UPDATE {} 
                SET {} = ?
                WHERE rowid = ?
            '''.format(table_name, column_name), (plane_data_json, i + 1))
            print("Row {} updated successfully.".format(i + 1))
        except sqlite3.Error as e:
            print("Error updating row {}: {}".format(i + 1, e))

# Commit changes and close the connection
conn.commit()
conn.close()
# ---------- end python_6 ----------

# ---- group: Updates JSON to the database but not as one row
python_7 = GhPythonScript()  # -> out, a; inputs Intermediate_PLNS: list of Plane
# ---------- python_7: Python ----------
import sqlite3
import json
import Rhino.Geometry as rg

# Assuming Intermediate_PLNS is a Grasshopper input variable
# Access the data directly from the Grasshopper input
data_list = Intermediate_PLNS

# Connect to the SQLite database
conn = sqlite3.connect(r'D:\Courses\Python projects\Robotic Fabrication Database\Robotic Fabrication\kuka.db')
c = conn.cursor()

# Specify the table name and column name
table_name = 'robot_data'
column_name = 'preference_script'

# Update the database with the plane data
for i, data in enumerate(data_list):
    if isinstance(data, rg.Plane):
        # Create a dictionary with plane information
        plane_dict = {
            'Origin': [data.OriginX, data.OriginY, data.OriginZ],
            'XAxis': [data.XAxis.X, data.XAxis.Y, data.XAxis.Z],
            'YAxis': [data.YAxis.X, data.YAxis.Y, data.YAxis.Z],
            'ZAxis': [data.ZAxis.X, data.ZAxis.Y, data.ZAxis.Z]
        }

        # Convert the dictionary to a JSON string
        plane_data_json = json.dumps(plane_dict)

        try:
            c.execute('''
                UPDATE {} 
                SET {} = ?
                WHERE rowid = ?
            '''.format(table_name, column_name), (plane_data_json, i + 1))
            print("Row {} updated successfully.".format(i + 1))
        except sqlite3.Error as e:
            print("Error updating row {}: {}".format(i + 1, e))

# Commit changes and close the connection
conn.commit()
conn.close()
# ---------- end python_7 ----------

# ---- group: Serialize/deserialize json but not update database
python_8 = GhPythonScript()  # -> out, a; inputs Intermediate_PLNS: Plane
# ---------- python_8: Python ----------
import sqlite3
import json
import Rhino.Geometry as rg

# Serialize function for Rhino.Geometry.Plane
def serialize_plane(plane):
    options = rg.FileIO.SerializationOptions()
    return plane.ToJSON(options)

# Deserialize function for Rhino.Geometry.Plane
def deserialize_plane(json_string):
    json_dict = json.loads(json_string)
    sys_dict = System.Collections.Generic.Dictionary[str, str]()
    
    for key in json_dict.keys():
        value = str(json_dict[key])
        sys_dict.Add(key, value)

    return rg.Plane.FromJSON(sys_dict)

# Assuming Intermediate_PLNS is a Grasshopper input variable
# Access the data directly from the Grasshopper input
Intermediate_PLNS = ghenv.Component.Params.Input[0].VolatileData.AllData(True)

# Connect to the SQLite database
conn = sqlite3.connect(r'D:\Courses\Python projects\Robotic Fabrication Database\Robotic Fabrication\kuka.db')
c = conn.cursor()

# Specify the table name and column name
table_name = 'robot_data'
column_name = 'intermediate_pln'

# Serialize and update the database with the plane data
for i, data in enumerate(Intermediate_PLNS):
    if isinstance(data, rg.Plane):
        # Serialize the plane
        plane_data_json = serialize_plane(data)

        try:
            c.execute('''
                UPDATE {} 
                SET {} = ?
                WHERE rowid = ?
            '''.format(table_name, column_name), (plane_data_json, i + 1))
            print("Row {} updated successfully.".format(i + 1))
        except sqlite3.Error as e:
            print("Error updating row {}: {}".format(i + 1, e))

# Commit changes and close the connection
conn.commit()
conn.close()
a = Intermediate_PLNS
# ---------- end python_8 ----------

# ---- group: No errors but does not update database
python_9 = GhPythonScript()  # -> out, a
# ---------- python_9: Python ----------
import sqlite3
import json
import Rhino.Geometry as rg

# Assuming Intermediate_PLNS is a Grasshopper input variable
# Access the data directly from the Grasshopper input
Intermediate_PLNS = ghenv.Component.Params.Input[0].VolatileData.AllData(True)

# Connect to the SQLite database
conn = sqlite3.connect(r'D:\Courses\Python projects\Robotic Fabrication Database\Robotic Fabrication\kuka.db')
c = conn.cursor()

# Specify the table name and column name
table_name = 'robot_data'
column_name = 'intermediate_pln'

# Iterate through Intermediate_PLNS and insert each plane information into the database
for i, data in enumerate(Intermediate_PLNS):
    if isinstance(data, rg.Plane):
        o_values = list(data.Origin)
        z_values = list(data.ZAxis)
        
        data_dict = {'O': o_values, 'Z': z_values}
        data_str = json.dumps(data_dict)
        
        c.execute("INSERT INTO {} ({}) VALUES (?)".format(table_name, column_name), (data_str,))

# Commit changes and close the connection
conn.commit()
conn.close()
a=Intermediate_PLNS
# ---------- end python_9 ----------

# ----
# test 9
intermediateplns = Plane([Plane(origin=(-35.57, 649.42, 390.58), x=(0, 0.342262483, -0.9396043809), y=(0.9964992714, -0.07855228693, -0.02861363923)), Plane(origin=(-35.42, 650.52, 339.11), x=(0, 0.4287072853, -0.9034434479), y=(0.9950305691, -0.08995578078, -0.04268634486)), Plane(origin=(-35.42, 650.52, 339.11), x=(0, 0.4287072853, -0.9034434479), y=(0.9950305691, -0.08995578078, -0.04268634486)), Plane(origin=(-35.3, 651.02, 289.98), x=(0, 0.4269530416, -0.9042737972), y=(0.9918997588, -0.1148636632, -0.05423289993)), Plane(origin=(-35.12, 651.79, 240.62), x=(0, 0.4212576039, -0.9069410296), y=(0.9919611536, -0.11476682, -0.05330709939)), Plane(origin=(-59.15, 651.59, 240.82), x=(0, 0.4219291275, -0.9066288167), y=(0.9920534078, -0.1140697451, -0.05308605588))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])
structurallyrecpln = Plane(Tree({1}: [Plane(origin=(-35.57, 649.42, 390.58), x=(0, 0.342262483, -0.9396043809), y=(0.9964992714, -0.07855228693, -0.02861363923)), Plane(origin=(-35.57, 649.42, 340.58), x=(0, 0.342262483, -0.9396043809), y=(0.9964992714, -0.07855228693, -0.02861363923))], {2}: [Plane(origin=(-35.42, 650.52, 339.11), x=(0, 0.4287072853, -0.9034434479), y=(0.9950305691, -0.08995578078, -0.04268634486)), Plane(origin=(-35.42, 650.52, 289.11), x=(0, 0.4287072853, -0.9034434479), y=(0.9950305691, -0.08995578078, -0.04268634486))], {3}: [Plane(origin=(-35.42, 650.52, 339.11), x=(0, 0.4287072853, -0.9034434479), y=(0.9950305691, -0.08995578078, -0.04268634486)), Plane(origin=(-35.42, 650.52, 289.11), x=(0, 0.4287072853, -0.9034434479), y=(0.9950305691, -0.08995578078, -0.04268634486))], {4}: [Plane(origin=(-35.3, 651.02, 289.98), x=(0, 0.4269530416, -0.9042737972), y=(0.9918997588, -0.1148636632, -0.05423289993)), Plane(origin=(-35.3, 651.02, 239.98), x=(0, 0.4269530416, -0.9042737972), y=(0.9918997588, -0.1148636632, -0.05423289993))], {5}: [Plane(origin=(-35.12, 651.79, 240.62), x=(0, 0.4212576039, -0.9069410296), y=(0.9919611536, -0.11476682, -0.05330709939)), Plane(origin=(-60.12, 651.79, 240.62), x=(0, 0.4212576039, -0.9069410296), y=(0.9919611536, -0.11476682, -0.05330709939))], {6}: [Plane(origin=(-59.15, 651.59, 240.82), x=(0, 0.4219291275, -0.9066288167), y=(0.9920534078, -0.1140697451, -0.05308605588)), Plane(origin=(-84.15, 651.59, 240.82), x=(0, 0.4219291275, -0.9066288167), y=(0.9920534078, -0.1140697451, -0.05308605588))]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))

# ----
# Test 11
intermediateplns_2 = Plane([Plane(origin=(-35.61, 649.41, 390.48), x=(0, 0.3422454295, -0.9396105927), y=(0.9964996184, -0.07854891963, -0.02861079786)), Plane(origin=(-35.53, 650.35, 352.41), x=(0, 0.4281974614, -0.9036851963), y=(0.9951064699, -0.08929175046, -0.04230953547)), Plane(origin=(-35.81, 651.49, 313.53), x=(0, 0.4270942274, -0.9042071228), y=(0.9920969907, -0.113453895, -0.05358894263)), Plane(origin=(-35.57, 652.47, 273.64), x=(0, 0.4216541929, -0.9067567158), y=(0.9919424984, -0.1148760196, -0.05341890992)), Plane(origin=(-35.46, 652.84, 234.5), x=(0, 0.4213088086, -0.9069172442), y=(0.9921385326, -0.1134956555, -0.05272445717)), Plane(origin=(-35.45, 629.3, 234.4), x=(0, 0.4212709684, -0.9069348219), y=(0.9921720754, -0.1132564168, -0.05260757359))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])
structurallyrecpln_2 = Plane(Tree({1}: [Plane(origin=(-35.61, 649.41, 390.48), x=(0, 0.3422454295, -0.9396105927), y=(0.9964996184, -0.07854891963, -0.02861079786)), Plane(origin=(-35.61, 649.41, 351.48), x=(0, 0.3422454295, -0.9396105927), y=(0.9964996184, -0.07854891963, -0.02861079786))], {2}: [Plane(origin=(-35.53, 650.35, 352.41), x=(0, 0.4281974614, -0.9036851963), y=(0.9951064699, -0.08929175046, -0.04230953547)), Plane(origin=(-35.53, 650.35, 313.41), x=(0, 0.4281974614, -0.9036851963), y=(0.9951064699, -0.08929175046, -0.04230953547))], {3}: [Plane(origin=(-35.81, 651.49, 313.53), x=(0, 0.4270942274, -0.9042071228), y=(0.9920969907, -0.113453895, -0.05358894263)), Plane(origin=(-35.81, 651.49, 274.53), x=(0, 0.4270942274, -0.9042071228), y=(0.9920969907, -0.113453895, -0.05358894263))], {4}: [Plane(origin=(-35.57, 652.47, 273.64), x=(0, 0.4216541929, -0.9067567158), y=(0.9919424984, -0.1148760196, -0.05341890992)), Plane(origin=(-35.57, 652.47, 234.64), x=(0, 0.4216541929, -0.9067567158), y=(0.9919424984, -0.1148760196, -0.05341890992))], {5}: [Plane(origin=(-35.46, 652.84, 234.5), x=(0, 0.4213088086, -0.9069172442), y=(0.9921385326, -0.1134956555, -0.05272445717)), Plane(origin=(-35.46, 627.84, 234.5), x=(0, 0.4213088086, -0.9069172442), y=(0.9921385326, -0.1134956555, -0.05272445717))], {6}: [Plane(origin=(-35.45, 629.3, 234.4), x=(0, 0.4212709684, -0.9069348219), y=(0.9921720754, -0.1132564168, -0.05260757359)), Plane(origin=(-35.45, 629.3, 195.4), x=(0, 0.4212709684, -0.9069348219), y=(0.9921720754, -0.1132564168, -0.05260757359))]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))

# ----
# TEST 13
structurallyrecpln_3 = Plane(Tree({1}: [Plane(origin=(-35.56, 649.43, 390.59), x=(0, 0.342215663, -0.9396214344), y=(0.996494741, -0.07860443657, -0.02862819896)), Plane(origin=(-35.56, 674.43, 390.59), x=(0, 0.342215663, -0.9396214344), y=(0.996494741, -0.07860443657, -0.02862819896))], {2}: [Plane(origin=(-35.56, 649.43, 390.59), x=(0, 0.342215663, -0.9396214344), y=(0.996494741, -0.07860443657, -0.02862819896)), Plane(origin=(-35.56, 624.43, 390.59), x=(0, 0.342215663, -0.9396214344), y=(0.996494741, -0.07860443657, -0.02862819896))], {3}: [Plane(origin=(-35.55, 649.41, 390.47), x=(0, 0.3421986111, -0.9396276446), y=(0.996499492, -0.07855176068, -0.02860739949)), Plane(origin=(-35.55, 649.41, 340.47), x=(0, 0.3421986111, -0.9396276446), y=(0.996499492, -0.07855176068, -0.02860739949))], {4}: [Plane(origin=(-35.71, 650.59, 336.48), x=(0, 0.4285895107, -0.9034993256), y=(0.9950182837, -0.09007219999, -0.04272720413)), Plane(origin=(-35.71, 650.59, 286.48), x=(0, 0.4285895107, -0.9034993256), y=(0.9950182837, -0.09007219999, -0.04272720413))], {5}: [Plane(origin=(-35.61, 651.16, 287.26), x=(0, 0.4268916733, -0.9043027697), y=(0.9919001482, -0.1148645931, -0.05422380645)), Plane(origin=(-35.61, 651.16, 237.26), x=(0, 0.4268916733, -0.9043027697), y=(0.9919001482, -0.1148645931, -0.05422380645))], {6}: [Plane(origin=(-35.46, 651.91, 237.86), x=(0, 0.4211761567, -0.9069788559), y=(0.9919495018, -0.1148544175, -0.0533352479)), Plane(origin=(-35.46, 651.91, 187.86), x=(0, 0.4211761567, -0.9069788559), y=(0.9919495018, -0.1148544175, -0.0533352479))]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))
intermediateplns_3 = Plane([Plane(origin=(-35.56, 649.43, 390.59), x=(0, 0.342215663, -0.9396214344), y=(0.996494741, -0.07860443657, -0.02862819896)), Plane(origin=(-35.56, 649.43, 390.59), x=(0, 0.342215663, -0.9396214344), y=(0.996494741, -0.07860443657, -0.02862819896)), Plane(origin=(-35.55, 649.41, 390.47), x=(0, 0.3421986111, -0.9396276446), y=(0.996499492, -0.07855176068, -0.02860739949)), Plane(origin=(-35.71, 650.59, 336.48), x=(0, 0.4285895107, -0.9034993256), y=(0.9950182837, -0.09007219999, -0.04272720413)), Plane(origin=(-35.61, 651.16, 287.26), x=(0, 0.4268916733, -0.9043027697), y=(0.9919001482, -0.1148645931, -0.05422380645)), Plane(origin=(-35.46, 651.91, 237.86), x=(0, 0.4211761567, -0.9069788559), y=(0.9919495018, -0.1148544175, -0.0533352479))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])

# ----
# Test 6
intermediateplns_4 = Plane([Plane(origin=(-35.6, 649.45, 390.51), x=(0, 0.342215663, -0.9396214344), y=(0.996499145, -0.07855512838, -0.02861024063)), Plane(origin=(-35.55, 650.06, 341.61), x=(0, 0.428491409, -0.9035458552), y=(0.9950704225, -0.08960539606, -0.04249385042)), Plane(origin=(-35.55, 650.06, 341.61), x=(0, 0.428491409, -0.9035458552), y=(0.9950704225, -0.08960539606, -0.04249385042)), Plane(origin=(-47.2, 650.86, 341.58), x=(0, 0.4270329132, -0.9042360815), y=(0.9922102015, -0.1126451567, -0.05319760008)), Plane(origin=(-47.2, 650.86, 341.58), x=(0, 0.4270329132, -0.9042360815), y=(0.9922102015, -0.1126451567, -0.05319760008)), Plane(origin=(-47.11, 651.49, 292.32), x=(0, 0.4216719006, -0.9067484812), y=(0.9919470561, -0.1148426143, -0.05340610372))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])
structurallyrecpln_4 = Plane(Tree({6}: [Plane(origin=(-47.11, 651.49, 292.32), x=(0, 0.4216719006, -0.9067484812), y=(0.9919470561, -0.1148426143, -0.05340610372)), Plane(origin=(-47.11, 601.49, 292.32), x=(0, 0.4216719006, -0.9067484812), y=(0.9919470561, -0.1148426143, -0.05340610372))], {7}: [Plane(origin=(-47.11, 651.49, 292.32), x=(0, 0.4216719006, -0.9067484812), y=(0.9919470561, -0.1148426143, -0.05340610372)), Plane(origin=(-47.11, 601.49, 292.32), x=(0, 0.4216719006, -0.9067484812), y=(0.9919470561, -0.1148426143, -0.05340610372))], {8}: [Plane(origin=(-35.59, 649.44, 390.52), x=(0, 0.342215663, -0.9396214344), y=(0.996499145, -0.07855512838, -0.02861024063)), Plane(origin=(-35.59, 649.44, 340.52), x=(0, 0.342215663, -0.9396214344), y=(0.996499145, -0.07855512838, -0.02861024063))], {9}: [Plane(origin=(-35.59, 649.44, 390.52), x=(0, 0.342215663, -0.9396214344), y=(0.996499145, -0.07855512838, -0.02861024063)), Plane(origin=(-35.59, 649.44, 340.52), x=(0, 0.342215663, -0.9396214344), y=(0.996499145, -0.07855512838, -0.02861024063))], {10}: [Plane(origin=(-35.48, 650.06, 341.65), x=(0, 0.4285502652, -0.9035179413), y=(0.9950740536, -0.089569703, -0.04248407057)), Plane(origin=(-35.48, 650.06, 291.65), x=(0, 0.4285502652, -0.9035179413), y=(0.9950740536, -0.089569703, -0.04248407057))], {11}: [Plane(origin=(-35.48, 650.06, 341.65), x=(0, 0.4285502652, -0.9035179413), y=(0.9950740536, -0.089569703, -0.04248407057)), Plane(origin=(-35.48, 650.06, 291.65), x=(0, 0.4285502652, -0.9035179413), y=(0.9950740536, -0.089569703, -0.04248407057))]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))

# ----
# Test 12
intermediateplns_5 = Plane([Plane(origin=(41.8, 583.55, 155.54), x=(0, 0.4216856198, -0.9067421012), y=(0.9921018083, -0.1137374219, -0.05289424104)), Plane(origin=(-35.49, 649.32, 390.32), x=(0, 0.3421517902, -0.9396446948), y=(0.9965081649, -0.07845598377, -0.02856809116)), Plane(origin=(-35.41, 650.34, 350.32), x=(0, 0.4284892771, -0.9035468662), y=(0.9951189549, -0.08916440016, -0.04228445784)), Plane(origin=(-35.46, 651.77, 309.99), x=(0, 0.4270745578, -0.9042164133), y=(0.9921291292, -0.1132250502, -0.05347783732)), Plane(origin=(-35.89, 652.08, 266.93), x=(0, 0.4216297222, -0.9067680946), y=(0.991811917, -0.1158007873, -0.05384513867)), Plane(origin=(-35.76, 653.05, 226.44), x=(0, 0.4209876277, -0.9070663798), y=(0.9921901686, -0.1131423762, -0.05251163708))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])
structurallyrecpln_5 = Plane(Tree({0}: [Plane(origin=(-35.52, 649.38, 390.44), x=(0, 0.3421986111, -0.9396276446), y=(0.9965038929, -0.07850245391, -0.02858944269)), Plane(origin=(-35.52, 674.38, 390.44), x=(0, 0.3421986111, -0.9396276446), y=(0.9965038929, -0.07850245391, -0.02858944269))], {1}: [Plane(origin=(41.8, 583.55, 155.54), x=(0, 0.4216856198, -0.9067421012), y=(0.9921018083, -0.1137374219, -0.05289424104)), Plane(origin=(41.8, 608.55, 155.54), x=(0, 0.4216856198, -0.9067421012), y=(0.9921018083, -0.1137374219, -0.05289424104))], {2}: [Plane(origin=(-35.49, 649.32, 390.32), x=(0, 0.3421517902, -0.9396446948), y=(0.9965081649, -0.07845598377, -0.02856809116)), Plane(origin=(-35.49, 649.32, 349.32), x=(0, 0.3421517902, -0.9396446948), y=(0.9965081649, -0.07845598377, -0.02856809116))], {3}: [Plane(origin=(-35.41, 650.34, 350.32), x=(0, 0.4284892771, -0.9035468662), y=(0.9951189549, -0.08916440016, -0.04228445784)), Plane(origin=(-35.41, 650.34, 309.32), x=(0, 0.4284892771, -0.9035468662), y=(0.9951189549, -0.08916440016, -0.04228445784))], {4}: [Plane(origin=(-35.46, 651.77, 309.99), x=(0, 0.4270745578, -0.9042164133), y=(0.9921291292, -0.1132250502, -0.05347783732)), Plane(origin=(-35.46, 651.77, 268.99), x=(0, 0.4270745578, -0.9042164133), y=(0.9921291292, -0.1132250502, -0.05347783732))], {5}: [Plane(origin=(-35.89, 652.08, 266.93), x=(0, 0.4216297222, -0.9067680946), y=(0.991811917, -0.1158007873, -0.05384513867)), Plane(origin=(-35.89, 652.08, 225.93), x=(0, 0.4216297222, -0.9067680946), y=(0.991811917, -0.1158007873, -0.05384513867))]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))

# ----
# test 10
structurallyrecpln_6 = Plane(Tree({0}: [Plane(origin=(-35.52, 649.38, 390.44), x=(0, 0.3421986111, -0.9396276446), y=(0.9965038929, -0.07850245391, -0.02858944269)), Plane(origin=(-35.52, 674.38, 390.44), x=(0, 0.3421986111, -0.9396276446), y=(0.9965038929, -0.07850245391, -0.02858944269)), Plane(origin=(-35.52, 649.38, 390.44), x=(0, 0.3421986111, -0.9396276446), y=(0.9965038929, -0.07850245391, -0.02858944269)), Plane(origin=(-35.52, 674.38, 390.44), x=(0, 0.3421986111, -0.9396276446), y=(0.9965038929, -0.07850245391, -0.02858944269))], {1}: [Plane(origin=(-35.57, 649.42, 390.5), x=(0, 0.3422454295, -0.9396105927), y=(0.9964996184, -0.07854891963, -0.02861079786)), Plane(origin=(-35.57, 649.42, 355.5), x=(0, 0.3422454295, -0.9396105927), y=(0.9964996184, -0.07854891963, -0.02861079786))], {2}: [Plane(origin=(-35.55, 650.5, 355.11), x=(0, 0.4279076459, -0.9038224641), y=(0.9950502764, -0.08981534211, -0.04252236821)), Plane(origin=(-35.55, 650.5, 320.11), x=(0, 0.4279076459, -0.9038224641), y=(0.9950502764, -0.08981534211, -0.04252236821))], {3}: [Plane(origin=(-35.56, 651.58, 320.9), x=(0, 0.4268176419, -0.9043377138), y=(0.9920651304, -0.1136978642, -0.05366165043)), Plane(origin=(-35.56, 651.58, 285.9), x=(0, 0.4268176419, -0.9043377138), y=(0.9920651304, -0.1136978642, -0.05366165043))], {4}: [Plane(origin=(-35.27, 652.11, 285.84), x=(0, 0.4212243875, -0.9069564572), y=(0.991927903, -0.115004923, -0.05341257331)), Plane(origin=(-35.27, 627.11, 285.84), x=(0, 0.4212243875, -0.9069564572), y=(0.991927903, -0.115004923, -0.05341257331))], {5}: [Plane(origin=(-35.46, 628.73, 284.65), x=(0, 0.420663819, -0.9072165956), y=(0.9921698925, -0.1133073377, -0.05253904926)), Plane(origin=(-35.46, 628.73, 249.65), x=(0, 0.420663819, -0.9072165956), y=(0.9921698925, -0.1133073377, -0.05253904926))]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))
intermediateplns_6 = Plane([Plane(origin=(-35.57, 649.42, 390.5), x=(0, 0.3422454295, -0.9396105927), y=(0.9964996184, -0.07854891963, -0.02861079786)), Plane(origin=(-35.55, 650.5, 355.11), x=(0, 0.4279076459, -0.9038224641), y=(0.9950502764, -0.08981534211, -0.04252236821)), Plane(origin=(-35.56, 651.58, 320.9), x=(0, 0.4268176419, -0.9043377138), y=(0.9920651304, -0.1136978642, -0.05366165043)), Plane(origin=(-35.27, 652.11, 285.84), x=(0, 0.4212243875, -0.9069564572), y=(0.991927903, -0.115004923, -0.05341257331)), Plane(origin=(-35.46, 628.73, 284.65), x=(0, 0.420663819, -0.9072165956), y=(0.9921698925, -0.1133073377, -0.05253904926)), Plane(origin=(-35.32, 629.6, 250.18), x=(0, 0.4215904998, -0.9067863312), y=(0.9922144975, -0.1129318228, -0.05250518451))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])

# ----
# TEST 14
intermediateplns_7 = Plane([Plane(origin=(-35.51, 649.47, 390.54), x=(0, 0.342215663, -0.9396214344), y=(0.996494741, -0.07860443657, -0.02862819896)), Plane(origin=(-35.34, 650.36, 341.66), x=(0, 0.4286918716, -0.9034507619), y=(0.9951178114, -0.0891653334, -0.04230939335)), Plane(origin=(-35.28, 651.86, 292.36), x=(0, 0.4272342476, -0.9041409722), y=(0.9921000246, -0.1134239033, -0.05359626152)), Plane(origin=(-35.07, 652.78, 242.98), x=(0, 0.4218229985, -0.9066781998), y=(0.9919949821, -0.1144928714, -0.05326666765)), Plane(origin=(-46.32, 652.98, 242.97), x=(0, 0.4220950918, -0.9065515614), y=(0.9920656833, -0.1139722448, -0.05306606613)), Plane(origin=(-57.46, 652.94, 243.07), x=(0, 0.4222581661, -0.9064756153), y=(0.9920443579, -0.1141151347, -0.05315757721))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])
structurallyrecpln_7 = Plane(Tree({0}: [Plane(origin=(-35.52, 649.38, 390.44), x=(0, 0.3421986111, -0.9396276446), y=(0.9965038929, -0.07850245391, -0.02858944269)), Plane(origin=(-35.52, 674.38, 390.44), x=(0, 0.3421986111, -0.9396276446), y=(0.9965038929, -0.07850245391, -0.02858944269)), Plane(origin=(-35.52, 649.38, 390.44), x=(0, 0.3421986111, -0.9396276446), y=(0.9965038929, -0.07850245391, -0.02858944269)), Plane(origin=(-35.52, 661.88, 390.44), x=(0, 0.3421986111, -0.9396276446), y=(0.9965038929, -0.07850245391, -0.02858944269))], {1}: [Plane(origin=(-35.51, 649.47, 390.54), x=(0, 0.342215663, -0.9396214344), y=(0.996494741, -0.07860443657, -0.02862819896)), Plane(origin=(-35.51, 649.47, 340.54), x=(0, 0.342215663, -0.9396214344), y=(0.996494741, -0.07860443657, -0.02862819896))], {2}: [Plane(origin=(-35.34, 650.36, 341.66), x=(0, 0.4286918716, -0.9034507619), y=(0.9951178114, -0.0891653334, -0.04230939335)), Plane(origin=(-35.34, 650.36, 291.66), x=(0, 0.4286918716, -0.9034507619), y=(0.9951178114, -0.0891653334, -0.04230939335))], {3}: [Plane(origin=(-35.28, 651.86, 292.36), x=(0, 0.4272342476, -0.9041409722), y=(0.9921000246, -0.1134239033, -0.05359626152)), Plane(origin=(-35.28, 651.86, 242.36), x=(0, 0.4272342476, -0.9041409722), y=(0.9921000246, -0.1134239033, -0.05359626152))], {4}: [Plane(origin=(-35.07, 652.78, 242.98), x=(0, 0.4218229985, -0.9066781998), y=(0.9919949821, -0.1144928714, -0.05326666765)), Plane(origin=(-47.57, 652.78, 242.98), x=(0, 0.4218229985, -0.9066781998), y=(0.9919949821, -0.1144928714, -0.05326666765))], {5}: [Plane(origin=(-46.32, 652.98, 242.97), x=(0, 0.4220950918, -0.9065515614), y=(0.9920656833, -0.1139722448, -0.05306606613)), Plane(origin=(-58.82, 652.98, 242.97), x=(0, 0.4220950918, -0.9065515614), y=(0.9920656833, -0.1139722448, -0.05306606613))]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))

# ----
# test 4
intermediateplns_8 = Plane([Plane(origin=(53.95, 710.17, 154.58), x=(0, 0.4225872615, -0.906322242), y=(0.9921305716, -0.1134783814, -0.05291111287)), Plane(origin=(53.95, 710.17, 154.58), x=(0, 0.4225872615, -0.906322242), y=(0.9921305716, -0.1134783814, -0.05291111287)), Plane(origin=(-35.6, 649.45, 390.59), x=(0, 0.342215663, -0.9396214344), y=(0.996494741, -0.07860443657, -0.02862819896)), Plane(origin=(-35.53, 650.51, 341.63), x=(0, 0.42857201, -0.9035076271), y=(0.9951441021, -0.08893111407, -0.0421838014)), Plane(origin=(-35.67, 652.12, 292.22), x=(0, 0.4270352236, -0.9042349904), y=(0.9921054359, -0.1133969952, -0.05355301633)), Plane(origin=(-59.63, 652.13, 292.5), x=(0, 0.4220193923, -0.9065868036), y=(0.9918530084, -0.1154879495, -0.05376005265))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])
structurallyrecpln_8 = Plane(Tree({87}: [Plane(origin=(-126.36, 660.77, 195.43), x=(0, 0.4212695966, -0.9069354591), y=(0.9920956768, -0.1138056497, -0.05286248285)), Plane(origin=(-126.36, 648.27, 195.43), x=(0, 0.4212695966, -0.9069354591), y=(0.9920956768, -0.1138056497, -0.05286248285))], {88}: [Plane(origin=(-126.36, 660.77, 195.43), x=(0, 0.4212695966, -0.9069354591), y=(0.9920956768, -0.1138056497, -0.05286248285)), Plane(origin=(-126.36, 648.27, 195.43), x=(0, 0.4212695966, -0.9069354591), y=(0.9920956768, -0.1138056497, -0.05286248285))], {89}: [Plane(origin=(-35.58, 649.45, 390.53), x=(0, 0.342262483, -0.9396043809), y=(0.9964992714, -0.07855228693, -0.02861363923)), Plane(origin=(-35.58, 649.45, 340.53), x=(0, 0.342262483, -0.9396043809), y=(0.9964992714, -0.07855228693, -0.02861363923))], {90}: [Plane(origin=(-35.58, 649.45, 390.53), x=(0, 0.342262483, -0.9396043809), y=(0.9964992714, -0.07855228693, -0.02861363923)), Plane(origin=(-35.58, 649.45, 340.53), x=(0, 0.342262483, -0.9396043809), y=(0.9964992714, -0.07855228693, -0.02861363923))], {91}: [Plane(origin=(-35.44, 650.06, 341.67), x=(0, 0.4285895107, -0.9034993256), y=(0.995073158, -0.0895759793, -0.04249181383)), Plane(origin=(-35.44, 650.06, 291.67), x=(0, 0.4285895107, -0.9034993256), y=(0.995073158, -0.0895759793, -0.04249181383))], {92}: [Plane(origin=(-35.44, 650.06, 341.67), x=(0, 0.4285895107, -0.9034993256), y=(0.995073158, -0.0895759793, -0.04249181383)), Plane(origin=(-35.44, 650.06, 291.67), x=(0, 0.4285895107, -0.9034993256), y=(0.995073158, -0.0895759793, -0.04249181383))]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))

# ----
# test 3
intermediateplns_9 = Plane([Plane(origin=(-35.59, 649.39, 390.58), x=(0, 0.342262483, -0.9396043809), y=(0.9964992714, -0.07855228693, -0.02861363923)), Plane(origin=(-35.59, 649.39, 390.58), x=(0, 0.342262483, -0.9396043809), y=(0.9964992714, -0.07855228693, -0.02861363923)), Plane(origin=(-35.67, 650.06, 341), x=(0, 0.4283280806, -0.9036232928), y=(0.9949957799, -0.09028728834, -0.04279723777)), Plane(origin=(-35.7, 651.52, 291.67), x=(0, 0.4268986577, -0.9042994725), y=(0.9921332481, -0.1132059349, -0.05344187751)), Plane(origin=(-35.7, 651.52, 291.67), x=(0, 0.4268986577, -0.9042994725), y=(0.9921332481, -0.1132059349, -0.05344187751)), Plane(origin=(-35.38, 676.27, 291.62), x=(0, 0.4218651931, -0.906658568), y=(0.9918736992, -0.1153509338, -0.05367240291))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])
structurallyrecpln_9 = Plane(Tree({0}: [Plane(origin=(-35.52, 649.38, 390.44), x=(0, 0.3421986111, -0.9396276446), y=(0.9965038929, -0.07850245391, -0.02858944269)), Plane(origin=(-35.52, 674.38, 390.44), x=(0, 0.3421986111, -0.9396276446), y=(0.9965038929, -0.07850245391, -0.02858944269))], {1}: [Plane(origin=(-35.59, 649.39, 390.58), x=(0, 0.342262483, -0.9396043809), y=(0.9964992714, -0.07855228693, -0.02861363923)), Plane(origin=(-35.59, 649.39, 340.58), x=(0, 0.342262483, -0.9396043809), y=(0.9964992714, -0.07855228693, -0.02861363923))], {2}: [Plane(origin=(-35.59, 649.39, 390.58), x=(0, 0.342262483, -0.9396043809), y=(0.9964992714, -0.07855228693, -0.02861363923)), Plane(origin=(-35.59, 649.39, 340.58), x=(0, 0.342262483, -0.9396043809), y=(0.9964992714, -0.07855228693, -0.02861363923))], {3}: [Plane(origin=(-35.67, 650.06, 341), x=(0, 0.4283280806, -0.9036232928), y=(0.9949957799, -0.09028728834, -0.04279723777)), Plane(origin=(-35.67, 650.06, 291), x=(0, 0.4283280806, -0.9036232928), y=(0.9949957799, -0.09028728834, -0.04279723777))], {4}: [Plane(origin=(-35.7, 651.52, 291.67), x=(0, 0.4268986577, -0.9042994725), y=(0.9921332481, -0.1132059349, -0.05344187751)), Plane(origin=(-35.7, 676.52, 291.67), x=(0, 0.4268986577, -0.9042994725), y=(0.9921332481, -0.1132059349, -0.05344187751))], {5}: [Plane(origin=(-35.7, 651.52, 291.67), x=(0, 0.4268986577, -0.9042994725), y=(0.9921332481, -0.1132059349, -0.05344187751)), Plane(origin=(-35.7, 676.52, 291.67), x=(0, 0.4268986577, -0.9042994725), y=(0.9921332481, -0.1132059349, -0.05344187751))]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))

# ---- group: Updates the database while automatically increasing the ID
python_10 = GhPythonScript(Intermediate_PLNS=intermediateplns_9)  # -> out, a; inputs Intermediate_PLNS: list of Plane
# ---------- python_10: Python ----------
import sqlite3
import json
import Rhino.Geometry as rg

# Assuming Intermediate_PLNS is a Grasshopper input variable
# Access the data directly from the Grasshopper input
data_list = Intermediate_PLNS

# Connect to the SQLite database
conn = sqlite3.connect(r"D:\Courses\Python projects\Robotic Fabrication Database\Intermediate pln\plane.db")
c = conn.cursor()

# Specify the table name and column name
table_name = 'robot_data'
column_name = 'intermediate_pln'

# Determine the next available row ID
c.execute('SELECT MAX(id) FROM {}'.format(table_name))
max_id = c.fetchone()[0]
next_row_id = max_id + 1 if max_id is not None else 1

# Create a list to store plane data dictionaries
plane_data_list = []

# Iterate over the plane data and create dictionaries
for i, data in enumerate(data_list):
    if isinstance(data, rg.Plane):
        plane_dict = {
            'Origin': [data.OriginX, data.OriginY, data.OriginZ],
            'XAxis': [data.XAxis.X, data.XAxis.Y, data.XAxis.Z],
            'YAxis': [data.YAxis.X, data.YAxis.Y, data.YAxis.Z],
            'ZAxis': [data.ZAxis.X, data.ZAxis.Y, data.ZAxis.Z]
        }
        plane_data_list.append(plane_dict)

# Convert the list of dictionaries to a JSON string
all_plane_data_json = json.dumps(plane_data_list)

try:
    # Update the database with the concatenated plane data
    c.execute('''
        INSERT OR REPLACE INTO {} (id, {}) 
        VALUES (?, ?)
    '''.format(table_name, column_name), (next_row_id, all_plane_data_json))
    print("Row updated successfully. Row ID: {}".format(next_row_id))
except sqlite3.Error as e:
    print("Error updating row: {}".format(e))

# Commit changes and close the connection
conn.commit()
conn.close()

a = Intermediate_PLNS
# ---------- end python_10 ----------

# ----
# test 5
intermediateplns_10 = Plane([Plane(origin=(-35.62, 649.43, 390.63), x=(0, 0.3422327164, -0.9396152233), y=(0.9964943934, -0.07860780657, -0.02863104227)), Plane(origin=(-35.62, 649.43, 390.63), x=(0, 0.3422327164, -0.9396152233), y=(0.9964943934, -0.07860780657, -0.02863104227)), Plane(origin=(-35.59, 649.45, 390.53), x=(0, 0.342215663, -0.9396214344), y=(0.996499145, -0.07855512838, -0.02861024063)), Plane(origin=(-35.59, 649.45, 390.53), x=(0, 0.342215663, -0.9396214344), y=(0.996499145, -0.07855512838, -0.02861024063)), Plane(origin=(-35.54, 650.17, 341.71), x=(0, 0.4284717935, -0.9035551573), y=(0.9950857839, -0.08946693949, -0.04242581066)), Plane(origin=(-35.54, 650.17, 341.71), x=(0, 0.4284717935, -0.9035551573), y=(0.9950857839, -0.08946693949, -0.04242581066))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])
structurallyrecpln_10 = Plane(Tree({0}: [Plane(origin=(-35.52, 649.38, 390.44), x=(0, 0.3421986111, -0.9396276446), y=(0.9965038929, -0.07850245391, -0.02858944269)), Plane(origin=(-35.52, 661.88, 390.44), x=(0, 0.3421986111, -0.9396276446), y=(0.9965038929, -0.07850245391, -0.02858944269))], {1}: [Plane(origin=(-35.62, 649.43, 390.63), x=(0, 0.3422327164, -0.9396152233), y=(0.9964943934, -0.07860780657, -0.02863104227)), Plane(origin=(-35.62, 649.43, 340.63), x=(0, 0.3422327164, -0.9396152233), y=(0.9964943934, -0.07860780657, -0.02863104227)), Plane(origin=(-35.62, 649.43, 390.63), x=(0, 0.3422327164, -0.9396152233), y=(0.9964943934, -0.07860780657, -0.02863104227)), Plane(origin=(-35.62, 649.43, 340.63), x=(0, 0.3422327164, -0.9396152233), y=(0.9964943934, -0.07860780657, -0.02863104227)), Plane(origin=(-35.62, 649.43, 390.63), x=(0, 0.3422327164, -0.9396152233), y=(0.9964943934, -0.07860780657, -0.02863104227)), Plane(origin=(-35.62, 649.43, 340.63), x=(0, 0.3422327164, -0.9396152233), y=(0.9964943934, -0.07860780657, -0.02863104227))], {2}: [Plane(origin=(-35.62, 649.43, 390.63), x=(0, 0.3422327164, -0.9396152233), y=(0.9964943934, -0.07860780657, -0.02863104227)), Plane(origin=(-35.62, 649.43, 340.63), x=(0, 0.3422327164, -0.9396152233), y=(0.9964943934, -0.07860780657, -0.02863104227))], {3}: [Plane(origin=(-35.59, 649.45, 390.53), x=(0, 0.342215663, -0.9396214344), y=(0.996499145, -0.07855512838, -0.02861024063)), Plane(origin=(-35.59, 649.45, 340.53), x=(0, 0.342215663, -0.9396214344), y=(0.996499145, -0.07855512838, -0.02861024063))], {4}: [Plane(origin=(-35.59, 649.45, 390.53), x=(0, 0.342215663, -0.9396214344), y=(0.996499145, -0.07855512838, -0.02861024063)), Plane(origin=(-35.59, 649.45, 340.53), x=(0, 0.342215663, -0.9396214344), y=(0.996499145, -0.07855512838, -0.02861024063))], {5}: [Plane(origin=(-35.54, 650.17, 341.71), x=(0, 0.4284717935, -0.9035551573), y=(0.9950857839, -0.08946693949, -0.04242581066)), Plane(origin=(-35.54, 650.17, 291.71), x=(0, 0.4284717935, -0.9035551573), y=(0.9950857839, -0.08946693949, -0.04242581066))]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))

python_11 = GhPythonScript(Intermediate_PLNS=intermediateplns_8)  # -> out, a; inputs Intermediate_PLNS: list of Plane; same code as python_4
python_12 = GhPythonScript(Intermediate_PLNS=intermediateplns_9)  # -> out, a; inputs Intermediate_PLNS: list of Plane
# ---------- python_12: Python ----------
import sqlite3
import json
import Rhino.Geometry as rg

# Assuming Intermediate_PLNS is a Grasshopper input variable
# Access the data directly from the Grasshopper input
data_list = Intermediate_PLNS

# Connect to the SQLite database
conn = sqlite3.connect(r"D:\Courses\Python projects\Robotic Fabrication Database\Intermediate pln\plane.db")
c = conn.cursor()

# Specify the table name and column name
table_name = 'robot_data'
column_name = 'intermediate_pln'

# Create a list to store plane data dictionaries
plane_data_list = []

# Iterate over the plane data and create dictionaries
for i, data in enumerate(data_list):
    if isinstance(data, rg.Plane):
        plane_dict = {
            'Origin': [data.OriginX, data.OriginY, data.OriginZ],
            'XAxis': [data.XAxis.X, data.XAxis.Y, data.XAxis.Z],
            'YAxis': [data.YAxis.X, data.YAxis.Y, data.YAxis.Z],
            'ZAxis': [data.ZAxis.X, data.ZAxis.Y, data.ZAxis.Z]
        }
        plane_data_list.append(plane_dict)

# Convert the list of dictionaries to a JSON string
all_plane_data_json = json.dumps(plane_data_list)

try:
    # Update the database with the concatenated plane data
    c.execute('''
        INSERT OR REPLACE INTO {} (id, {}) 
        VALUES (?, ?)
    '''.format(table_name, column_name), (1, all_plane_data_json))
    print("Row updated successfully.")
except sqlite3.Error as e:
    print("Error updating row: {}".format(e))

# Commit changes and close the connection
conn.commit()
conn.close()
a = Intermediate_PLNS
# ---------- end python_12 ----------

# ----
# Kuka|CRC (local) - Connect
connect_to_crc = BooleanToggle(True)
broker = MqttBroker(BrokerIP="192.168.1.2", BrokerPort=1883, Connect=connect_to_crc)
panel_3 = Panel(broker)

python_13 = GhPythonScript(Intermediate_PLNS=intermediateplns_9)  # -> out, a; inputs Intermediate_PLNS: list of Plane; same code as python_10

# ----
# Kuka|CRC (local) - Listen
subscribe = BooleanToggle(True)
# 2- Control connection
# -First step: click Play button  -> see the changing data
# 
# -Second step: click Pause button -> to ensure real-time computing
# 3- Move the robot to the home position
# Notes: In this phase, we need to first set robot to a starting position, which is called "Home Position".
# 
# Any motion will start from this position, then recursively continue, i.e., taking the TCP (action plane) when a sensor threshold measurement is exceeded, and compute the robotic action accordingly.
trigger = Trigger(Interval=500, TimerInterval=500, Target=subscriber)  # disabled
subscriber = MqttSubscriber(Topic="rhea/state", Subscribe=subscribe)
deserialize_json = CSharpScript(
    Data=subscriber,
    Reference="D:\FIDEL GATIMU\MSC CONSTRUCTION AND ROBOTICS\SEMESTER 3\PROTOTYPING PROJECT\LECTURE MATERIAL-20231024\WEEK-6\MCU_Local\Newtonsoft.Json.dll")  # -> out, toolPose, toolPlane, state, Force_sensor; inputs Data: String
# ---------- deserialize_json: C# usings ----------
using System.Linq;
using Newtonsoft.Json;
using Newtonsoft.Json.Linq;
# ---------- deserialize_json: C# ----------
    JObject cmdDict = JObject.Parse(Data);
    Print(cmdDict.ToString());

    toolPose = new List<double>{(double) cmdDict["toolPose"]["X"],
        (double) cmdDict["toolPose"]["Y"],
        (double) cmdDict["toolPose"]["Z"],
        (double) cmdDict["toolPose"]["A"],
        (double) cmdDict["toolPose"]["B"],
        (double) cmdDict["toolPose"]["C"]};

    Point3d toolPoint = new Point3d((double) cmdDict["toolPose"]["X"], (double) cmdDict["toolPose"]["Y"], (double) cmdDict["toolPose"]["Z"]);
    Vector3d toolVector = new Vector3d((double) cmdDict["toolPose"]["B"], (double) cmdDict["toolPose"]["C"], -(double) cmdDict["toolPose"]["A"]);
    toolPlane = new Plane(toolPoint, toolVector);

    state = (string) cmdDict["state"];

    Force_sensor = new List<double>{(double) cmdDict["toolTrq"]["X"],
        (double) cmdDict["toolTrq"]["Y"],
        (double) cmdDict["toolTrq"]["Z"],
        (double) cmdDict["toolTrq"]["A"],
        (double) cmdDict["toolTrq"]["B"],
        (double) cmdDict["toolTrq"]["C"]};
# ---------- end deserialize_json ----------

panel_5 = Panel(python_12.a)

# ----
# Test 00
structurallyrecpln_11 = Plane(Tree({1}: [Plane(origin=(-35.57, 649.44, 390.64), x=(0, 0.342215663, -0.9396214344), y=(0.996494741, -0.07860443657, -0.02862819896)), Plane(origin=(-35.57, 649.44, 340.64), x=(0, 0.342215663, -0.9396214344), y=(0.996494741, -0.07860443657, -0.02862819896))], {2}: [Plane(origin=(-35.55, 650.33, 341.7), x=(0, 0.4284521795, -0.9035644581), y=(0.9951011205, -0.08932848619, -0.04235778008)), Plane(origin=(-35.55, 650.33, 291.7), x=(0, 0.4284521795, -0.9035644581), y=(0.9951011205, -0.08932848619, -0.04235778008))], {3}: [Plane(origin=(-35.76, 651.72, 292.36), x=(0, 0.4268536388, -0.9043207235), y=(0.9921146322, -0.1133419354, -0.05349918043)), Plane(origin=(-35.76, 651.72, 242.36), x=(0, 0.4268536388, -0.9043207235), y=(0.9921146322, -0.1133419354, -0.05349918043))], {4}: [Plane(origin=(-35.76, 651.72, 292.36), x=(0, 0.4268536388, -0.9043207235), y=(0.9921146322, -0.1133419354, -0.05349918043)), Plane(origin=(-35.76, 651.72, 242.36), x=(0, 0.4268536388, -0.9043207235), y=(0.9921146322, -0.1133419354, -0.05349918043))], {5}: [Plane(origin=(-35.81, 652.53, 242.91), x=(0, 0.4214081229, -0.9068711011), y=(0.9919512035, -0.1148286829, -0.05335900513)), Plane(origin=(-35.81, 652.53, 192.91), x=(0, 0.4214081229, -0.9068711011), y=(0.9919512035, -0.1148286829, -0.05335900513))], {6}: [Plane(origin=(-35.79, 653.37, 193.52), x=(0, 0.4210284147, -0.9070474486), y=(0.9922018353, -0.1130558075, -0.05247763773)), Plane(origin=(-35.79, 653.37, 143.52), x=(0, 0.4210284147, -0.9070474486), y=(0.9922018353, -0.1130558075, -0.05247763773))]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))
# EXPLANATION: Take the StructurallyRecPLN that contains the toolpath to be customised.
# ***Part-1***
# Pattern collection
intermediateplns_11 = Plane([Plane(origin=(-35.57, 649.44, 390.64), x=(0, 0.342215663, -0.9396214344), y=(0.996494741, -0.07860443657, -0.02862819896)), Plane(origin=(-35.55, 650.33, 341.7), x=(0, 0.4284521795, -0.9035644581), y=(0.9951011205, -0.08932848619, -0.04235778008)), Plane(origin=(-35.76, 651.72, 292.36), x=(0, 0.4268536388, -0.9043207235), y=(0.9921146322, -0.1133419354, -0.05349918043)), Plane(origin=(-35.76, 651.72, 292.36), x=(0, 0.4268536388, -0.9043207235), y=(0.9921146322, -0.1133419354, -0.05349918043)), Plane(origin=(-35.81, 652.53, 242.91), x=(0, 0.4214081229, -0.9068711011), y=(0.9919512035, -0.1148286829, -0.05335900513)), Plane(origin=(-35.79, 653.37, 193.52), x=(0, 0.4210284147, -0.9070474486), y=(0.9922018353, -0.1130558075, -0.05247763773))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])

# ----
# Test 01
intermediateplns_12 = Plane([Plane(origin=(-35.54, 649.44, 390.55), x=(0, 0.342215663, -0.9396214344), y=(0.996499145, -0.07855512838, -0.02861024063)), Plane(origin=(-35.55, 650.35, 341.64), x=(0, 0.4284521795, -0.9035644581), y=(0.9951110349, -0.08923827024, -0.04231500148)), Plane(origin=(-35.81, 651.82, 292.25), x=(0, 0.4267923427, -0.9043496538), y=(0.9921212912, -0.1132978816, -0.05346899632)), Plane(origin=(-35.94, 652.6, 242.8), x=(0, 0.4213267512, -0.9069089087), y=(0.9919459491, -0.1148707951, -0.05336604201)), Plane(origin=(-47.46, 652.85, 242.79), x=(0, 0.4214205232, -0.9068653388), y=(0.9920799235, -0.1139097426, -0.05293388254)), Plane(origin=(-58.9, 652.93, 242.87), x=(0, 0.4217719829, -0.9067019325), y=(0.9920656104, -0.1139916712, -0.05302568736))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])
# 6- Customization of toolpaths (chaning rotations and translations of recorded toolpaths)
structurallyrecpln_12 = Plane(Tree({1}: [Plane(origin=(-35.54, 649.44, 390.55), x=(0, 0.342215663, -0.9396214344), y=(0.996499145, -0.07855512838, -0.02861024063)), Plane(origin=(-35.54, 649.44, 340.55), x=(0, 0.342215663, -0.9396214344), y=(0.996499145, -0.07855512838, -0.02861024063))], {2}: [Plane(origin=(-35.55, 650.35, 341.64), x=(0, 0.4284521795, -0.9035644581), y=(0.9951110349, -0.08923827024, -0.04231500148)), Plane(origin=(-35.55, 650.35, 291.64), x=(0, 0.4284521795, -0.9035644581), y=(0.9951110349, -0.08923827024, -0.04231500148))], {3}: [Plane(origin=(-35.81, 651.82, 292.25), x=(0, 0.4267923427, -0.9043496538), y=(0.9921212912, -0.1132978816, -0.05346899632)), Plane(origin=(-35.81, 651.82, 242.25), x=(0, 0.4267923427, -0.9043496538), y=(0.9921212912, -0.1132978816, -0.05346899632))], {4}: [Plane(origin=(-35.94, 652.6, 242.8), x=(0, 0.4213267512, -0.9069089087), y=(0.9919459491, -0.1148707951, -0.05336604201)), Plane(origin=(-48.44, 652.6, 242.8), x=(0, 0.4213267512, -0.9069089087), y=(0.9919459491, -0.1148707951, -0.05336604201))], {5}: [Plane(origin=(-47.46, 652.85, 242.79), x=(0, 0.4214205232, -0.9068653388), y=(0.9920799235, -0.1139097426, -0.05293388254)), Plane(origin=(-59.96, 652.85, 242.79), x=(0, 0.4214205232, -0.9068653388), y=(0.9920799235, -0.1139097426, -0.05293388254))], {6}: [Plane(origin=(-58.9, 652.93, 242.87), x=(0, 0.4217719829, -0.9067019325), y=(0.9920656104, -0.1139916712, -0.05302568736)), Plane(origin=(-58.9, 665.43, 242.87), x=(0, 0.4217719829, -0.9067019325), y=(0.9920656104, -0.1139916712, -0.05302568736))]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))

panel_6 = Panel(structurallyrecpln_9)

# ----
# Test 00
structurallyrecpln_13 = Plane(Tree({1}: [Plane(origin=(-35.57, 649.44, 390.64), x=(0, 0.342215663, -0.9396214344), y=(0.996494741, -0.07860443657, -0.02862819896)), Plane(origin=(-35.57, 649.44, 340.64), x=(0, 0.342215663, -0.9396214344), y=(0.996494741, -0.07860443657, -0.02862819896))], {2}: [Plane(origin=(-35.55, 650.33, 341.7), x=(0, 0.4284521795, -0.9035644581), y=(0.9951011205, -0.08932848619, -0.04235778008)), Plane(origin=(-35.55, 650.33, 291.7), x=(0, 0.4284521795, -0.9035644581), y=(0.9951011205, -0.08932848619, -0.04235778008))], {3}: [Plane(origin=(-35.76, 651.72, 292.36), x=(0, 0.4268536388, -0.9043207235), y=(0.9921146322, -0.1133419354, -0.05349918043)), Plane(origin=(-35.76, 651.72, 242.36), x=(0, 0.4268536388, -0.9043207235), y=(0.9921146322, -0.1133419354, -0.05349918043))], {4}: [Plane(origin=(-35.76, 651.72, 292.36), x=(0, 0.4268536388, -0.9043207235), y=(0.9921146322, -0.1133419354, -0.05349918043)), Plane(origin=(-35.76, 651.72, 242.36), x=(0, 0.4268536388, -0.9043207235), y=(0.9921146322, -0.1133419354, -0.05349918043))], {5}: [Plane(origin=(-35.81, 652.53, 242.91), x=(0, 0.4214081229, -0.9068711011), y=(0.9919512035, -0.1148286829, -0.05335900513)), Plane(origin=(-35.81, 652.53, 192.91), x=(0, 0.4214081229, -0.9068711011), y=(0.9919512035, -0.1148286829, -0.05335900513))], {6}: [Plane(origin=(-35.79, 653.37, 193.52), x=(0, 0.4210284147, -0.9070474486), y=(0.9922018353, -0.1130558075, -0.05247763773)), Plane(origin=(-35.79, 653.37, 143.52), x=(0, 0.4210284147, -0.9070474486), y=(0.9922018353, -0.1130558075, -0.05247763773))]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))
# ***Part-1***
# Pattern collection
intermediateplns_13 = Plane([Plane(origin=(-35.57, 649.44, 390.64), x=(0, 0.342215663, -0.9396214344), y=(0.996494741, -0.07860443657, -0.02862819896)), Plane(origin=(-35.55, 650.33, 341.7), x=(0, 0.4284521795, -0.9035644581), y=(0.9951011205, -0.08932848619, -0.04235778008)), Plane(origin=(-35.76, 651.72, 292.36), x=(0, 0.4268536388, -0.9043207235), y=(0.9921146322, -0.1133419354, -0.05349918043)), Plane(origin=(-35.76, 651.72, 292.36), x=(0, 0.4268536388, -0.9043207235), y=(0.9921146322, -0.1133419354, -0.05349918043)), Plane(origin=(-35.81, 652.53, 242.91), x=(0, 0.4214081229, -0.9068711011), y=(0.9919512035, -0.1148286829, -0.05335900513)), Plane(origin=(-35.79, 653.37, 193.52), x=(0, 0.4210284147, -0.9070474486), y=(0.9922018353, -0.1130558075, -0.05247763773))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])

# ----
# Test 01
intermediateplns_14 = Plane([Plane(origin=(-35.54, 649.44, 390.55), x=(0, 0.342215663, -0.9396214344), y=(0.996499145, -0.07855512838, -0.02861024063)), Plane(origin=(-35.55, 650.35, 341.64), x=(0, 0.4284521795, -0.9035644581), y=(0.9951110349, -0.08923827024, -0.04231500148)), Plane(origin=(-35.81, 651.82, 292.25), x=(0, 0.4267923427, -0.9043496538), y=(0.9921212912, -0.1132978816, -0.05346899632)), Plane(origin=(-35.94, 652.6, 242.8), x=(0, 0.4213267512, -0.9069089087), y=(0.9919459491, -0.1148707951, -0.05336604201)), Plane(origin=(-47.46, 652.85, 242.79), x=(0, 0.4214205232, -0.9068653388), y=(0.9920799235, -0.1139097426, -0.05293388254)), Plane(origin=(-58.9, 652.93, 242.87), x=(0, 0.4217719829, -0.9067019325), y=(0.9920656104, -0.1139916712, -0.05302568736))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])
structurallyrecpln_14 = Plane(Tree({1}: [Plane(origin=(-35.54, 649.44, 390.55), x=(0, 0.342215663, -0.9396214344), y=(0.996499145, -0.07855512838, -0.02861024063)), Plane(origin=(-35.54, 649.44, 340.55), x=(0, 0.342215663, -0.9396214344), y=(0.996499145, -0.07855512838, -0.02861024063))], {2}: [Plane(origin=(-35.55, 650.35, 341.64), x=(0, 0.4284521795, -0.9035644581), y=(0.9951110349, -0.08923827024, -0.04231500148)), Plane(origin=(-35.55, 650.35, 291.64), x=(0, 0.4284521795, -0.9035644581), y=(0.9951110349, -0.08923827024, -0.04231500148))], {3}: [Plane(origin=(-35.81, 651.82, 292.25), x=(0, 0.4267923427, -0.9043496538), y=(0.9921212912, -0.1132978816, -0.05346899632)), Plane(origin=(-35.81, 651.82, 242.25), x=(0, 0.4267923427, -0.9043496538), y=(0.9921212912, -0.1132978816, -0.05346899632))], {4}: [Plane(origin=(-35.94, 652.6, 242.8), x=(0, 0.4213267512, -0.9069089087), y=(0.9919459491, -0.1148707951, -0.05336604201)), Plane(origin=(-48.44, 652.6, 242.8), x=(0, 0.4213267512, -0.9069089087), y=(0.9919459491, -0.1148707951, -0.05336604201))], {5}: [Plane(origin=(-47.46, 652.85, 242.79), x=(0, 0.4214205232, -0.9068653388), y=(0.9920799235, -0.1139097426, -0.05293388254)), Plane(origin=(-59.96, 652.85, 242.79), x=(0, 0.4214205232, -0.9068653388), y=(0.9920799235, -0.1139097426, -0.05293388254))], {6}: [Plane(origin=(-58.9, 652.93, 242.87), x=(0, 0.4217719829, -0.9067019325), y=(0.9920656104, -0.1139916712, -0.05302568736)), Plane(origin=(-58.9, 665.43, 242.87), x=(0, 0.4217719829, -0.9067019325), y=(0.9920656104, -0.1139916712, -0.05302568736))]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))

# ----
# 1- Connection with the iiwa-kuka robot
panel_7 = Panel(subscriber)

# ----
# *** Part-1 ***
# Collecting TCP and Force values
# !!! IMPORTANT !!!: Make sure to delete recorded data before creating a new pattern with robot
# Defining interaction
# with fabrication grammar
# !!! IMPORTANT !!!: You should change the path, where you store myPositions.tex
# EXPLANATION: Selects the last item in the list, last recorded string data.
# EXPLANATION: This component records the string data in a string list upon each interaction.
# EXPLANATION: Sorts the TCP and Force out of the string data
# My Grammatical Notation
# 
# ∘ : Simultenous rule application
# 
# ·  : Recursive rule application
# 
# ⟷ : Biconditional relations between action and sensing rules
# 
# → : Rule replacement
# 
# ⇒ : Measurable change in a material state (denotes sensor measurement range)
# 
# ∥ : Conditional relationships among rules
# ***Basic Transformation Vocabulary***
# tx -> translation X-axis
# ty -> translation Y-axis
# tz-> translation Z-axis
# rx->  axial rotation X-axis
# ry -> axial rotation Y-axis
# rz-> axial rotation Z-axis
# 
# ***Basic Force Sensor Vocabulary***
# 
# fx -> force along X-axis
# fy -> force along Y-axis
# fz-> force along Z-axis
# !!! IMPORTANT !!!: Make sure to delete recorded data before creating a new pattern with robot
path_0 = FilePath("C:\Users\Iremnur\Desktop\ForceFeedback\myPositions.txt")
panel_8 = Panel(path_0)
file = ReadFile(File=path_0, PerLineParse=True)
rec = DataRecorder(file, DataLimit=-10, RecordData=True)
last_rec_str = ListItem(List=rec, Index=-1, Wrap=True)
tcp_and_force = PythonScript(D=last_rec_str)  # -> X, Y, Z, RX, RY, RZ, FX, FY, FZ
# ---------- tcp_and_force: Python ----------
myList = D.split(",")

X = myList[0]
Y = myList[1]
Z = myList[2]
RX = myList[3]
RY = myList[4]
RZ = myList[5]

FX = myList[6]
FY = myList[7]
FZ = myList[8]

MX = myList[9]
MY = myList[10]
MZ = myList[11]
# ---------- end tcp_and_force ----------
rec_2 = DataRecorder(tcp_and_force.FX, DataLimit=-10, RecordData=True)
rec_3 = DataRecorder(tcp_and_force.FY, DataLimit=-10, RecordData=True)
rec_4 = DataRecorder(tcp_and_force.FZ, DataLimit=-10, RecordData=True)

# ----
# ***Part-2***
# Interactively generated toolpath
initial_pln = Plane(Plane(origin=(-35.52, 649.38, 390.44), x=(0, 0.3421986111, -0.9396276446), y=(0.9965038929, -0.07850245391, -0.02858944269)))
entwine = Entwine(Branch00=initial_pln, Branch01=structurallyrecpln_14, FlattenInputs=True)
gentoolpath = Plane(entwine)
panel_9 = Panel(gentoolpath)

# ----
# EXPLANATION: Gradual_Rot: Takes the planes list (toolpath) and rotates the selected planes (idx) with gradual increment of selected angle (inc_ang) about selected axis (rot_ax).
# For example, the first plane will rotate 0 degree, second will rotate inc_ang, third will rotate 2*inc_ang, ...
number_slider = Slider(1, range=0..7)
structurallyrecpln_15 = Plane(Tree({1}: [Plane(origin=(-35.54, 649.44, 390.55), x=(0, 0.342215663, -0.9396214344), y=(0.996499145, -0.07855512838, -0.02861024063)), Plane(origin=(-35.54, 649.44, 340.55), x=(0, 0.342215663, -0.9396214344), y=(0.996499145, -0.07855512838, -0.02861024063))], {2}: [Plane(origin=(-35.55, 650.35, 341.64), x=(0, 0.4284521795, -0.9035644581), y=(0.9951110349, -0.08923827024, -0.04231500148)), Plane(origin=(-35.55, 650.35, 291.64), x=(0, 0.4284521795, -0.9035644581), y=(0.9951110349, -0.08923827024, -0.04231500148))], {3}: [Plane(origin=(-35.81, 651.82, 292.25), x=(0, 0.4267923427, -0.9043496538), y=(0.9921212912, -0.1132978816, -0.05346899632)), Plane(origin=(-35.81, 651.82, 242.25), x=(0, 0.4267923427, -0.9043496538), y=(0.9921212912, -0.1132978816, -0.05346899632))], {4}: [Plane(origin=(-35.94, 652.6, 242.8), x=(0, 0.4213267512, -0.9069089087), y=(0.9919459491, -0.1148707951, -0.05336604201)), Plane(origin=(-48.44, 652.6, 242.8), x=(0, 0.4213267512, -0.9069089087), y=(0.9919459491, -0.1148707951, -0.05336604201))], {5}: [Plane(origin=(-47.46, 652.85, 242.79), x=(0, 0.4214205232, -0.9068653388), y=(0.9920799235, -0.1139097426, -0.05293388254)), Plane(origin=(-59.96, 652.85, 242.79), x=(0, 0.4214205232, -0.9068653388), y=(0.9920799235, -0.1139097426, -0.05293388254))], {6}: [Plane(origin=(-58.9, 652.93, 242.87), x=(0, 0.4217719829, -0.9067019325), y=(0.9920656104, -0.1139916712, -0.05302568736)), Plane(origin=(-58.9, 665.43, 242.87), x=(0, 0.4217719829, -0.9067019325), y=(0.9920656104, -0.1139916712, -0.05302568736))]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))
list = ValueList({"X", "Y", "Z"}, selected="Z")
pln = Plane(structurallyrecpln_15)
gradual_rot = GhPythonScript(myTree=pln, idx=number_slider, rot_ax=list, inc_ang=Slider(32, range=0..100))  # -> out, modifiedPLN; inputs myTree: tree of Plane, idx: Int32
# ---------- gradual_rot: Python ----------
__author__ = "iremnurtokac"

import rhinoscriptsyntax as rs
import Rhino.Geometry as rg
import ghpythonlib.treehelpers as gt
import itertools

#Convertin Iron.Python.RunList to tree
def conv(myList):
    fin = gt.list_to_tree(myList)
    return fin

def conv2(myDataTree):
    fin = gt.tree_to_list(myDataTree)
    return fin

#ROTATION
#rotates the end-effector tool around given axis 
def RotatePLN(myPLN, Ang, RotationAxis):
    if RotationAxis == 'X':
        myRotatedPLN = rs.RotatePlane(myPLN, Ang, myPLN.XAxis)
    if RotationAxis == 'Y':
        myRotatedPLN = rs.RotatePlane(myPLN, Ang, myPLN.YAxis)
    if RotationAxis == 'Z':
        myRotatedPLN = rs.RotatePlane(myPLN, Ang, myPLN.ZAxis)
    return myRotatedPLN 

#idx: index of the element to be transformed
#num: the number of elements in each branch
#step: step size to find to-be-changed elements

def TransformBranch(myBranchList,ang):
    for i in range(idx,len(myBranchList),idx+1):
        rotPLN=RotatePLN(myBranchList[i],ang,rot_ax)
        myBranchList[i]=rotPLN
    return myBranchList

myTransformedTree = []

for k in range (0, myTree.BranchCount):
    tempBranch= TransformBranch(myTree.Branch(k),inc_ang*k)
    myTransformedTree.append(tempBranch)
    
modifiedPLN=conv(myTransformedTree)
# ---------- end gradual_rot ----------

# ----
# EXPLANATION: Single_Rot: Takes the planes list (toolpath) and rotates the plane (idx) with selected angle (inc_ang) about selected axis (rot_ax).
number_slider_2 = Slider(1, range=0..7)
structurallyrecpln_16 = Plane(Tree({1}: [Plane(origin=(-35.54, 649.44, 390.55), x=(0, 0.342215663, -0.9396214344), y=(0.996499145, -0.07855512838, -0.02861024063)), Plane(origin=(-35.54, 649.44, 340.55), x=(0, 0.342215663, -0.9396214344), y=(0.996499145, -0.07855512838, -0.02861024063))], {2}: [Plane(origin=(-35.55, 650.35, 341.64), x=(0, 0.4284521795, -0.9035644581), y=(0.9951110349, -0.08923827024, -0.04231500148)), Plane(origin=(-35.55, 650.35, 291.64), x=(0, 0.4284521795, -0.9035644581), y=(0.9951110349, -0.08923827024, -0.04231500148))], {3}: [Plane(origin=(-35.81, 651.82, 292.25), x=(0, 0.4267923427, -0.9043496538), y=(0.9921212912, -0.1132978816, -0.05346899632)), Plane(origin=(-35.81, 651.82, 242.25), x=(0, 0.4267923427, -0.9043496538), y=(0.9921212912, -0.1132978816, -0.05346899632))], {4}: [Plane(origin=(-35.94, 652.6, 242.8), x=(0, 0.4213267512, -0.9069089087), y=(0.9919459491, -0.1148707951, -0.05336604201)), Plane(origin=(-48.44, 652.6, 242.8), x=(0, 0.4213267512, -0.9069089087), y=(0.9919459491, -0.1148707951, -0.05336604201))], {5}: [Plane(origin=(-47.46, 652.85, 242.79), x=(0, 0.4214205232, -0.9068653388), y=(0.9920799235, -0.1139097426, -0.05293388254)), Plane(origin=(-59.96, 652.85, 242.79), x=(0, 0.4214205232, -0.9068653388), y=(0.9920799235, -0.1139097426, -0.05293388254))], {6}: [Plane(origin=(-58.9, 652.93, 242.87), x=(0, 0.4217719829, -0.9067019325), y=(0.9920656104, -0.1139916712, -0.05302568736)), Plane(origin=(-58.9, 665.43, 242.87), x=(0, 0.4217719829, -0.9067019325), y=(0.9920656104, -0.1139916712, -0.05302568736))]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))
list_2 = ValueList({"X", "Y", "Z"}, selected="Z")
pln_2 = Plane(structurallyrecpln_16)
single_rot = GhPythonScript(myTree=pln_2, idx=number_slider_2, rot_ax=list_2, inc_ang=Slider(41, range=0..100))  # -> out, modifiedPLN; inputs myTree: tree of Plane, idx: Int32
# ---------- single_rot: Python ----------
__author__ = "iremnurtokac"

import rhinoscriptsyntax as rs
import Rhino.Geometry as rg
import ghpythonlib.treehelpers as gt
import itertools

#Convertin Iron.Python.RunList to tree
def conv(myList):
    fin = gt.list_to_tree(myList)
    return fin

def conv2(myDataTree):
    fin = gt.tree_to_list(myDataTree)
    return fin

#ROTATION
#rotates the end-effector tool around given axis 
def RotatePLN(myPLN, Ang, RotationAxis):
    if RotationAxis == 'X':
        myRotatedPLN = rs.RotatePlane(myPLN, Ang, myPLN.XAxis)
    if RotationAxis == 'Y':
        myRotatedPLN = rs.RotatePlane(myPLN, Ang, myPLN.YAxis)
    if RotationAxis == 'Z':
        myRotatedPLN = rs.RotatePlane(myPLN, Ang, myPLN.ZAxis)
    return myRotatedPLN 

#idx: index of the element to be transformed
#num: the number of elements in each branch
#step: step size to find to-be-changed elements

def TransformBranch(myBranchList,ang):
    for i in range(idx,len(myBranchList),idx+1):
        rotPLN=RotatePLN(myBranchList[i],ang,rot_ax)
        myBranchList[i]=rotPLN
    return myBranchList

myTransformedTree = []

for k in range (0, myTree.BranchCount):
    tempBranch= TransformBranch(myTree.Branch(k),inc_ang)
    myTransformedTree.append(tempBranch)
    
modifiedPLN=conv(myTransformedTree)
# ---------- end single_rot ----------

# ----
# KUKA|CRC - define home position
# in terms of robot axis rotations (in degrees)
a4 = Slider(70.4, range=-120..120)
a3 = Slider(-23.43, range=-170..170)
a5 = Slider(4.78, range=-170..170)
a1 = Slider(-68.13, range=-170..170)
a2 = Slider(-23.46, range=-120..120)
a6 = Slider(-72.42, range=-120..120)
a7 = Slider(25.68, range=-175..175)
merge = Merge(Data1=a1, Data2=a2, Data3=a3, Data4=a4, Data5=a5, Data6=a6, Data7=a7)
axis_positions = Panel(merge)
robot_name = Panel("rhea")
crc_move_axis = AXISMovementKUKACrc(Device=robot_name, AxisVals=axis_positions, Speed=-1, Sync=False)
cmd = Data(crc_move_axis)

a6_2 = Slider(-85, range=-120..120)
a7_2 = Slider(90, range=-175..175)

tz = Slider(0, range=-100..100)
structurallyrecpln_17 = Plane(Tree({1}: [Plane(origin=(-35.54, 649.44, 390.55), x=(0, 0.342215663, -0.9396214344), y=(0.996499145, -0.07855512838, -0.02861024063)), Plane(origin=(-35.54, 649.44, 340.55), x=(0, 0.342215663, -0.9396214344), y=(0.996499145, -0.07855512838, -0.02861024063))], {2}: [Plane(origin=(-35.55, 650.35, 341.64), x=(0, 0.4284521795, -0.9035644581), y=(0.9951110349, -0.08923827024, -0.04231500148)), Plane(origin=(-35.55, 650.35, 291.64), x=(0, 0.4284521795, -0.9035644581), y=(0.9951110349, -0.08923827024, -0.04231500148))], {3}: [Plane(origin=(-35.81, 651.82, 292.25), x=(0, 0.4267923427, -0.9043496538), y=(0.9921212912, -0.1132978816, -0.05346899632)), Plane(origin=(-35.81, 651.82, 242.25), x=(0, 0.4267923427, -0.9043496538), y=(0.9921212912, -0.1132978816, -0.05346899632))], {4}: [Plane(origin=(-35.94, 652.6, 242.8), x=(0, 0.4213267512, -0.9069089087), y=(0.9919459491, -0.1148707951, -0.05336604201)), Plane(origin=(-48.44, 652.6, 242.8), x=(0, 0.4213267512, -0.9069089087), y=(0.9919459491, -0.1148707951, -0.05336604201))], {5}: [Plane(origin=(-47.46, 652.85, 242.79), x=(0, 0.4214205232, -0.9068653388), y=(0.9920799235, -0.1139097426, -0.05293388254)), Plane(origin=(-59.96, 652.85, 242.79), x=(0, 0.4214205232, -0.9068653388), y=(0.9920799235, -0.1139097426, -0.05293388254))], {6}: [Plane(origin=(-58.9, 652.93, 242.87), x=(0, 0.4217719829, -0.9067019325), y=(0.9920656104, -0.1139916712, -0.05302568736)), Plane(origin=(-58.9, 665.43, 242.87), x=(0, 0.4217719829, -0.9067019325), y=(0.9920656104, -0.1139916712, -0.05302568736))]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))
pln_3 = Plane(structurallyrecpln_17)
single_trans = GhPythonScript(myTree=pln_3, idx=Slider(1, range=0..7), tx=Slider(0, range=-100..100), ty=Slider(0, range=-100..100), tz=tz)  # -> out, modifiedPLN; inputs myTree: tree of Plane, idx: Int32
# ---------- single_trans: Python ----------
__author__ = "iremnurtokac"

import rhinoscriptsyntax as rs
import Rhino.Geometry as rg
import ghpythonlib.treehelpers as gt
import itertools

#Convertin Iron.Python.RunList to tree
def conv(myList):
    fin = gt.list_to_tree(myList)
    return fin

def conv2(myDataTree):
    fin = gt.tree_to_list(myDataTree)
    return fin

#ROTATION
#rotates the end-effector tool about given axis 
def RotatePLN(myPLN, Ang, RotationAxis):
    if RotationAxis == 'X':
        myRotatedPLN = rs.RotatePlane(myPLN, Ang, myPLN.XAxis)
    if RotationAxis == 'Y':
        myRotatedPLN = rs.RotatePlane(myPLN, Ang, myPLN.YAxis)
    if RotationAxis == 'Z':
        myRotatedPLN = rs.RotatePlane(myPLN, Ang, myPLN.ZAxis)
    return myRotatedPLN 
    

#TRANSFORMATION
#translates the end-effector tool along given axis
def TranslatePLN(myPLN, x, y, z):
    myTranslatedPLN = rs.MovePlane(myPLN,rg.Point3d(myPLN.Origin.X+x, myPLN.Origin.Y+y, myPLN.Origin.Z+z))
    return myTranslatedPLN


#idx: index of the element to be transformed
#num: the number of elements in each branch
#step: step size to find to-be-changed elements

def TransformBranch(myBranchList,tx,ty,tz):
    for i in range(idx,len(myBranchList),idx+1):
        movePLN=TranslatePLN(myBranchList[i],tx, ty, tz)
        myBranchList[i]=movePLN
    return myBranchList

myTransformedTree = []

for k in range (0, myTree.BranchCount):
    tempBranch= TransformBranch(myTree.Branch(k),tx,ty,tz)
    myTransformedTree.append(tempBranch)
    
modifiedPLN=conv(myTransformedTree)
# ---------- end single_trans ----------

# ----
# EXPLANATION: Gradual_Trans: Takes the planes list (toolpath) and translates/moves the selected planes (idx) with gradual increment of selected distance (tx, ty, tz).
# 
# tx: distance along the X axis
# ty: distance along the Y axis
# tz: distance along the Z axis
# Remember: distance are in millimeters
number_slider_3 = Slider(1, range=0..7)
tz_2 = Slider(0, range=-100..100)
structurallyrecpln_18 = Plane(Tree({1}: [Plane(origin=(-35.54, 649.44, 390.55), x=(0, 0.342215663, -0.9396214344), y=(0.996499145, -0.07855512838, -0.02861024063)), Plane(origin=(-35.54, 649.44, 340.55), x=(0, 0.342215663, -0.9396214344), y=(0.996499145, -0.07855512838, -0.02861024063))], {2}: [Plane(origin=(-35.55, 650.35, 341.64), x=(0, 0.4284521795, -0.9035644581), y=(0.9951110349, -0.08923827024, -0.04231500148)), Plane(origin=(-35.55, 650.35, 291.64), x=(0, 0.4284521795, -0.9035644581), y=(0.9951110349, -0.08923827024, -0.04231500148))], {3}: [Plane(origin=(-35.81, 651.82, 292.25), x=(0, 0.4267923427, -0.9043496538), y=(0.9921212912, -0.1132978816, -0.05346899632)), Plane(origin=(-35.81, 651.82, 242.25), x=(0, 0.4267923427, -0.9043496538), y=(0.9921212912, -0.1132978816, -0.05346899632))], {4}: [Plane(origin=(-35.94, 652.6, 242.8), x=(0, 0.4213267512, -0.9069089087), y=(0.9919459491, -0.1148707951, -0.05336604201)), Plane(origin=(-48.44, 652.6, 242.8), x=(0, 0.4213267512, -0.9069089087), y=(0.9919459491, -0.1148707951, -0.05336604201))], {5}: [Plane(origin=(-47.46, 652.85, 242.79), x=(0, 0.4214205232, -0.9068653388), y=(0.9920799235, -0.1139097426, -0.05293388254)), Plane(origin=(-59.96, 652.85, 242.79), x=(0, 0.4214205232, -0.9068653388), y=(0.9920799235, -0.1139097426, -0.05293388254))], {6}: [Plane(origin=(-58.9, 652.93, 242.87), x=(0, 0.4217719829, -0.9067019325), y=(0.9920656104, -0.1139916712, -0.05302568736)), Plane(origin=(-58.9, 665.43, 242.87), x=(0, 0.4217719829, -0.9067019325), y=(0.9920656104, -0.1139916712, -0.05302568736))]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))
pln_4 = Plane(structurallyrecpln_18)
gradual_trans = GhPythonScript(myTree=pln_4, idx=number_slider_3, tx=Slider(-30.6, range=-100..100), ty=Slider(0, range=-100..100), tz=tz_2)  # -> out, modifiedPLN; inputs myTree: tree of Plane, idx: Int32
# ---------- gradual_trans: Python ----------
__author__ = "iremnurtokac"

import rhinoscriptsyntax as rs
import Rhino.Geometry as rg
import ghpythonlib.treehelpers as gt
import itertools

#Convertin Iron.Python.RunList to tree
def conv(myList):
    fin = gt.list_to_tree(myList)
    return fin

def conv2(myDataTree):
    fin = gt.tree_to_list(myDataTree)
    return fin

#ROTATION
#rotates the end-effector tool about given axis 
def RotatePLN(myPLN, Ang, RotationAxis):
    if RotationAxis == 'X':
        myRotatedPLN = rs.RotatePlane(myPLN, Ang, myPLN.XAxis)
    if RotationAxis == 'Y':
        myRotatedPLN = rs.RotatePlane(myPLN, Ang, myPLN.YAxis)
    if RotationAxis == 'Z':
        myRotatedPLN = rs.RotatePlane(myPLN, Ang, myPLN.ZAxis)
    return myRotatedPLN 
    

#TRANSFORMATION
#translates the end-effector tool along given axis
def TranslatePLN(myPLN, x, y, z):
    myTranslatedPLN = rs.MovePlane(myPLN,rg.Point3d(myPLN.Origin.X+x, myPLN.Origin.Y+y, myPLN.Origin.Z+z))
    return myTranslatedPLN


#idx: index of the element to be transformed
#num: the number of elements in each branch
#step: step size to find to-be-changed elements

def TransformBranch(myBranchList,tx,ty,tz):
    for i in range(idx,len(myBranchList),idx+1):
        movePLN=TranslatePLN(myBranchList[i],tx, ty, tz)
        myBranchList[i]=movePLN
    return myBranchList

myTransformedTree = []

for k in range (0, myTree.BranchCount):
    tempBranch= TransformBranch(myTree.Branch(k),tx*k,ty*k,tz*k)
    myTransformedTree.append(tempBranch)
    
modifiedPLN=conv(myTransformedTree)
# ---------- end gradual_trans ----------

# ----
# !!! IMPORTANT !!!: After interactively created the pattern, close python code. First, copy-paste (A) IntermediatePLNS, then right click on copied IntermediatePLNS, select "Internalise data".
# *** Part-2 ***
# Registered TCPs upon interaction
# !!! IMPORTANT !!!: Make sure to delete recorded data before creating a new pattern with robot
X = Number(tcp_and_force.X)
rz = Number(tcp_and_force.RZ)
ry = Number(tcp_and_force.RY)
Z = Number(tcp_and_force.Z)
rx = Number(tcp_and_force.RX)
Y = Number(tcp_and_force.Y)
getplane = GhPythonScript(x=X, y=Y, z=Z, rx=rx, ry=ry, rz=rz)  # -> PLN
# ---------- getplane: Python ----------
__author__ = "Iremnur"
__version__ = "2023.08.24"

import rhinoscriptsyntax as rs
import Rhino.Geometry as rg 

myPoint = rg.Point3d(x,y,z)
myVector = rg.Vector3d(ry,rz,-rx)

myPlane = rg.Plane(myPoint,myVector) 


a= myPoint
PLN= myPlane
# ---------- end getplane ----------
pln_5 = Plane(getplane)
rec_5 = DataRecorder(pln_5, DataLimit=-10, RecordData=True)

# ----
# *** Part-0 ***
# Robot's initial position
# Initial plane
# Intermediate points
# that are collected upon interaction
pln_6 = Plane(Plane(origin=(-35.52, 649.38, 390.44), x=(0, 0.3421986111, -0.9396276446), y=(0.9965038929, -0.07850245391, -0.02858944269)))
pt = ConstructPoint(XCoordinate=tcp_and_force.X, YCoordinate=tcp_and_force.Y, ZCoordinate=tcp_and_force.Z)
deplane = DeconstructPlane(Plane=pln_6)  # -> Origin, XAxis, YAxis, ZAxis
rec_6 = DataRecorder(pt, DataLimit=-10, RecordData=True)
mypointslist = Point(flatten([deplane.Origin, rec_6]))

# ----
# *** Part-3 ***
# Interpreting sensor readings
list_3 = ValueList({"None", "fx", "fy", "fz", "fx-fy"}, selected="None")
myforcelistx = Number(rec_2)
myforcelisty = Number(rec_3)
myforcelistz = Number(rec_4)
sensinterp = SensorInterpretation(Preference=list_3, x=myforcelistx, y=myforcelisty, z=myforcelistz)  # -> sensorState; inputs x: list, y: list, z: list
# ---------- sensinterp: Python ----------
__author__ = "iremnurtokac"

import rhinoscriptsyntax as rs

myForceState=[x[-1],y[-1],z[-1]]
f = max(enumerate(myForceState), key = lambda x: abs(x[1]))[0]

if Preference=="None":
    myForceState=[x[-1],y[-1],z[-1]]
    f = max(enumerate(myForceState), key = lambda x: abs(x[1]))[0]
    lastState= myForceState[f]
    if f == 0:
        myForceType = "fx"
    elif f == 1:
        myForceType = "fy"
    elif f ==2:
        myForceType = "fz"
    
else:
    myForceType=Preference    
    if Preference == "fx":
        lastState=x[-1]
    elif Preference == "fy":
        lastState=y[-1]
    elif Preference == "fz":
        lastState=z[-1]
    elif Preference == "fx-fy":
        myForceState=[x[-1],y[-1]]
        f = max(enumerate(myForceState), key = lambda x: abs(x[1]))[0]
        lastState= myForceState[f]
        if f == 0:
            myForceType = "fx"
        elif f == 1:
            myForceType = "fy"
        
        
sensorState=[myForceType,lastState]
# ---------- end sensinterp ----------

# ----
# Home position simulation
# !!! IMPORTANT !!!: Before, starting the process:
# ->Position the robot axes as same as these axis positions.
# 
# ->The axis positions should be registered to the simulation home position or starting position.
lbr14_r820 = IiwaLBR14R820Robot()
kmp_200 = KMP200MobilePlatformKUKAPrc(KUKAPrcRobotInput=lbr14_r820)
crc_prc_translator = PRCTranslatorKUKACrc(KUKACrcCmd=cmd, KUKAPrcRobot=kmp_200)
kuka_prc = KUKAPrcCORE(
    SimulationSlider=Slider(1, range=0..1),
    KUKAPrcCommands=crc_prc_translator,
    Robot=kmp_200,
    PRC_BaseExpose=False,
    PRC_SaveNameExpose=False,
    PRCsettings="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")  # -> RobotGeometry, AnalysisOutput

# ---- group: A
intermediateplns_15 = Plane(rec_5)

# ---- group: Robot pose
# Rotate TCP about Z-axis
# (Re)defining robot's plane
# Rotate TCP about Y-axis
# Rotate TCP about X-axis
xy = XYPlane(Origin=Point(0, 0, 0))
deplane_2 = DeconstructPlane(Plane=xy)  # -> Origin, XAxis, YAxis, ZAxis
pl = ConstructPlane(Origin=deplane_2.Origin, XAxis=expr("-x", deplane_2.XAxis), YAxis=deplane_2.YAxis)
pln_7 = Plane(pl)
list_4 = ValueList({"0", "90"}, selected="0")
list_5 = ValueList({"X", "Y", "Z"}, selected="Z")
rot = GhPythonScript(PLN=pln_6, rot_ax=list_5, ang=list_4)  # -> out, a; inputs PLN: Plane
# ---------- rot: Python ----------
__author__ = "iremnurtokac"

import rhinoscriptsyntax as rs
import Rhino.Geometry as rg
import ghpythonlib.treehelpers as gt
import itertools

#ROTATION
#rotates the end-effector tool around given axis 
def RotatePLN(myPLN, Ang, RotationAxis):
    if RotationAxis == 'X':
        myRotatedPLN = rs.RotatePlane(myPLN, Ang, myPLN.XAxis)
    if RotationAxis == 'Y':
        myRotatedPLN = rs.RotatePlane(myPLN, Ang, myPLN.YAxis)
    if RotationAxis == 'Z':
        myRotatedPLN = rs.RotatePlane(myPLN, Ang, myPLN.ZAxis)
    return myRotatedPLN 
    

a=RotatePLN(PLN,ang,rot_ax)
# ---------- end rot ----------
list_6 = ValueList({"X", "Y", "Z"}, selected="X")
rot_2 = GhPythonScript(PLN=rot.a, rot_ax=list_6, ang=Slider(0, range=-180..180))  # -> out, a; inputs PLN: Plane; same code as rot
list_7 = ValueList({"X", "Y", "Z"}, selected="Y")
rot_3 = GhPythonScript(PLN=rot_2.a, rot_ax=list_7, ang=Slider(0, range=-180..180))  # -> out, a; inputs PLN: Plane; same code as rot

# ----
# *** Part-5 ***
# Composition rules
# -> interaction rules
# Action rules-Segmented Regeneration: tx:0
# tx:0
# tx:0
# tx:0
# tx:0
# tx:0
# Sensing rules-Segmented Regeneration: fy:-30
# fy:30
# fx:-30
# fx:30
# fz:-30
# fz:30
action_rules = Panel("""ty:12.5
ty:-12.5
tx:-12.5
tx:12.5
tz:50
tz:-50""")
sensing_rules = Panel("""fx:10
fx:-10
fy:10
fy:-10
fz:25
fz:-25""")
comprules = CompositionRule(sensorState=sensinterp, A=action_rules, S=sensing_rules)  # -> C_i, C; inputs sensorState: list, A: list, S: list
# ---------- comprules: Python ----------
__author__ = "iremnurtokac"

import rhinoscriptsyntax as rs
import Rhino.Geometry as rg
import ghpythonlib.treehelpers as gt



#Convertin Iron.Python.RunList to tree
def conv(myList):
    fin = gt.list_to_tree(myList)
    return fin

#Finding the closest value in the sensing list and returning the index number
def Closest(myList, myNumber):
    minNumber= min(myList, key=lambda x:abs(x-myNumber))
    myIndex=myList.index(minNumber)
    return myIndex

#Selecting the force thresholds in the same type force trigger
def findIndex(my_list, my_elem):
    myIndexList=[]
    for itr in range(len(my_list)):
        if my_list[itr] == my_elem:
            myIndexList.append(itr)
    return myIndexList 


#Collecting first sensing states (triggers)

#Collecting type of the force
def myType(myStr):
    sep = myStr.find(':', 0, len(myStr))
    type = myStr[:sep]
    return type
    
#Collecting value of the force    
def myVal(myStr):
    sep = myStr.find(':', 0, len(myStr))
    val = float(myStr[(sep+1):])
    return val



'''
#Looking at the previous states

for i in range(len(S)):
    myString = S[i].split("=>")
    myFirstVals.append(myVal(myString[0]))
'''

#Initial state
if len(sensorState)==0:
    activatedActionRule = A[0]
    activatedSensingRule = S[0]

else:
    lastState = sensorState[1]
    myForceType = sensorState[0]
    
    #Collecing First Types
    k=0
    myFirstTypes = []
    for k in range(len(S)):
        myString = S[k].split("⇒")
        myFirstTypes.append(myType(myString[0]))
        myTypeIndexList= findIndex(myFirstTypes, myForceType)
    
    #Calling next transformation-sensing couple or next composition rule
    myFirstVals = []
    for t in range(0, len(myTypeIndexList)):
        myString = S[myTypeIndexList[t]].split("⇒")
        myFirstVals.append(myVal(myString[0]))
    lastRuleIndex=Closest(myFirstVals, lastState)
    a= myTypeIndexList[lastRuleIndex]
    activatedActionRule = A[a]
    activatedSensingRule = S[a]

C_i = "A{"+activatedActionRule+ "}"+"⟷"+"S{" +activatedSensingRule+"}"

C=conv([A,S])
# ---------- end comprules ----------

# ----
# *** Part-4 ***
# Collecting robot positions
pln_list = Plane([pln_6, intermediateplns_15])
pln_list_2 = Plane(flatten(pln_list))
lastpos = ListItem(List=pln_list_2, Index=-1, Wrap=True)

list_8 = ValueList({"iterated regeneration": "it_reg", "segmented regeneration": "seg_reg", "modified regeneration": "mod_reg"}, selected="segmented regeneration")
path = FilePath("C:\Users\Iremnur\Desktop\ForceFeedback\myMessages.txt")

# ----
# *** Part-7 ***
# Updated sensor thresholds
# EXPLANATION: Updated sensor thresholds sent to the middleware (Python code)
# !!! IMPORTANT !!!: You should change the Path-1, where you store mySensingPara.tex
# 
# You should change the Path-1, where you store myState.tex
path_1 = FilePath("C:\Users\Iremnur\Desktop\ForceFeedback\mySensingPara.txt")
path_2 = FilePath("C:\Users\Iremnur\Desktop\ForceFeedback\myState.txt")
sens = SensingEncoder(interaction_mode=list_8, myMsg=path, SensorType=path_1, SensorState=path_2, C_i=comprules.C_i)
# ---------- sens: Python ----------
__author__ = "iremnurtokac"

import rhinoscriptsyntax as rs

#Getting the list of what to find (index 0) and what to replace with (index 1)
def findItem(myStr):
    myTempList = myStr.split("S{")[1].split("}")[0].split("⟷")[0]
    return myTempList
    
sensing_rule = findItem(C_i)

##############################################
#TRANSFORMATION RULE CONVERSION

#Coverting comma deliminated str into a list 
myString = sensing_rule.split("⇒") 

###############################################

#SINGULAR TRANSFORMATIONS
 
def myType(myStr):
    sep = myStr.find(':', 0, len(myStr))
    type = myStr[:sep]
    return type
    
def myVal(myStr):
    sep = myStr.find(':', 0, len(myStr))
    val = float(myStr[(sep+1):])
    return val

myTypeInfo = []
myValInfo = []

for i in range(len(myString)):
    myTypeInfo.append(myType(myString[i]))
    myValInfo.append(myVal(myString[i]))
    
f1 = open(SensorType, "w")
f2 = open(SensorState, "w")
f3 = open(myMsg, "w") 

f1.writelines(myTypeInfo[-1])
f1.close()

f2.writelines(str(myValInfo[-1]))
f2.close()

f3.writelines(interaction_mode)
f3.close()
# ---------- end sens ----------

# ----
# *** Part-6 ***
# Updated action planes
# EXPLANATION: Last registered robot position (where the interaction occured).
init = Plane(lastpos)
act = ActionEncoder1(init=init, C_i=comprules.C_i)  # -> actionPLN; inputs init: Plane
# ---------- act: Python ----------
__author__ = "iremnurtokac"

import rhinoscriptsyntax as rs
import Rhino.Geometry as rg
import ghpythonlib.treehelpers as gt
import itertools

#The list of transformations that is interpreted based on myString

#Convertin Iron.Python.RunList to tree
def conv(myList):
    fin = gt.list_to_tree(myList)
    return fin

#Getting the list of what to find (index 0) and what to replace with (index 1)
def findItem(myStr):
    myTempList = myStr.split("A{")[1].split("}")[0].split("⟷")[0]
    return myTempList
    
action_rule = findItem(C_i)


##############################################
#TRANSFORMATION RULE CONVERSION

#Coverting comma deliminated str into a list 
myString = action_rule.split("·") 

###############################################

#MY TRANSFORMATION FUNCTIONS

#TRANSLATION
#Translates the end-effector tool point along given axis
def TranslatePLN(myPLN, x, y, z):
    myTranslatedPLN = rs.MovePlane(myPLN,rg.Point3d(myPLN.Origin.X+x, myPLN.Origin.Y+y, myPLN.Origin.Z+z))
    return myTranslatedPLN

#ROTATION
#rotates the end-effector tool around given axis 
def RotatePLN(myPLN, Ang, RotationAxis):
    if RotationAxis == 'X':
        myRotatedPLN = rs.RotatePlane(myPLN, Ang, myPLN.XAxis)
    if RotationAxis == 'Y':
        myRotatedPLN = rs.RotatePlane(myPLN, Ang, myPLN.YAxis)
    if RotationAxis == 'Z':
        myRotatedPLN = rs.RotatePlane(myPLN, Ang, myPLN.ZAxis)
    return myRotatedPLN 
    
#TURN
#Turn the direction of the end-effector tool    
def TurnPLN(myPlaneList): 
    myTransformedPlanes = []
    for i in range (0,len(myPlaneList)):
        xform = rs.XformRotation2(rotAng,rg.Vector3d(0,0,1),rg.Point3d(x[-1].Origin.X,x[-1].Origin.Y,x[-1].Origin.Z))
        myPLN1 = rs.PlaneTransform(myPlaneList[i],xform)
        myTransformedPlanes.append(myPLN1)
    return myTransformedPlanes


#Checking for combined transformation
def checkComb (myStr):
    info = myStr.find('∘', 0, len(myStr))
    return info 
    
#The info regarding to singular and combined transformations 
myInfo = []
i = 0 

for i in range(len(myString)):
    info = checkComb(myString[i])
    myInfo.append(info)
    
###########################################################################

#SINGULAR TRANSFORMATIONS
 
def singularTransformation(myStr,myPLN):
    sep = myStr.find(':', 0, len(myStr))
    type = myStr[:sep]
    val = float(myStr[(sep+1):])
    if type == 'tx':
        transformedPLN = TranslatePLN(myPLN, val, 0, 0)
    elif type == 'ty':
        transformedPLN = TranslatePLN(myPLN, 0, val, 0)
    elif type == 'tz':
        transformedPLN = TranslatePLN(myPLN, 0, 0, val)
    elif type == 'rx':
        transformedPLN = RotatePLN(myPLN, val, 'X')
    elif type == 'ry':
        transformedPLN = RotatePLN(myPLN, val, 'Y')
    elif type == 'rz':
        transformedPLN = RotatePLN(myPLN, val, 'Z')
    return transformedPLN


###########################################################################


#COMBINED TRANSFORMATIONS 

#Deconstructing combined transformations into types and values 

#Collecting transformation types
def Collect_Types(myStr):
    myTransList = myStr.split("∘")
    myTypes = []
    i = 0
    for i in range(len(myTransList)):
        sep = myTransList[i].find(':',0, len(myTransList[i]))
        type = myTransList[i][:sep]
        myTypes.append(type)
    return myTypes
    
    
#Collecting transformation values 
def Collect_Vals(myStr):
    myTransList = myStr.split("∘")
    myVals = []
    i = 0 
    for i in range(len(myTransList)):
        sep = myTransList[i].find(':',0, len(myTransList[i]))
        val = float(myTransList[i][(sep+1):])
        myVals.append(val)
    return myVals
        


#Combined transformations 
def combTransformation(myStr, myPLN):
    myTypes = Collect_Types(myStr)
    myVals = Collect_Vals(myStr)
    myTransformedPLN = []    
    i = 0
    for i in range(len(myTypes)):
        if len(myTransformedPLN) == 0:
            if myTypes[i] == 'tx':
                temp = TranslatePLN(myPLN, myVals[i], 0, 0)
            elif myTypes[i] == 'ty':
                temp = TranslatePLN(myPLN, 0, myVals[i], 0)
            elif myTypes[i] == 'tz':
                temp = TranslatePLN(myPLN, 0, 0, myVals[i])
            elif myTypes[i] == 'rx':
                temp = RotatePLN(myPLN, myVals[i], 'X')
            elif myTypes[i] == 'ry':
                temp = RotatePLN(myPLN, myVals[i], 'Y')
            elif myTypes[i] == 'rz':
                temp = RotatePLN(myPLN, myVals[i], 'Z')
            myTransformedPLN.append(temp)
            
        elif len(myTransformedPLN) > 0:
            if myTypes[i] == 'tx':
                temp = TranslatePLN(myTransformedPLN[i-1], myVals[i], 0, 0)
            elif myTypes[i] == 'ty':
                temp = TranslatePLN(myTransformedPLN[i-1], 0, myVals[i], 0)
            elif myTypes[i] == 'tz':
                temp = TranslatePLN(myTransformedPLN[i-1], 0, 0, myVals[i])
            elif myTypes[i] == 'rx':
                temp = RotatePLN(myTransformedPLN[i-1], myVals[i], 'X')
            elif myTypes[i] == 'ry':
                temp = RotatePLN(myTransformedPLN[i-1], myVals[i], 'Y')
            elif myTypes[i] == 'rz':
                temp = RotatePLN(myTransformedPLN[i-1], myVals[i], 'Z')                
            myTransformedPLN.append(temp)
    myMove = myTransformedPLN[-1]
    return myMove

####################################################################################




#Interpreting the motion information that is given by the transformation rule 

def interpretInfo(myInfo,myStr,initPt):
    myTransformations =[]
    i= 0 
    for i in range(len(myInfo)):
        if len(myTransformations) ==0:
            if myInfo[i]==-1:
                tempPLN = singularTransformation(myStr[i],initPt)
            else:
                tempPLN = combTransformation(myStr[i],initPt)
            myTransformations.append(tempPLN)
        else:
            if myInfo[i]==-1:
                tempPLN = singularTransformation(myStr[i], myTransformations[i-1])
            else:
                tempPLN = combTransformation(myStr[i], myTransformations[i-1])                
            myTransformations.append(tempPLN)
    myTransformations.insert(0,init)
    return myTransformations



actionPLN= interpretInfo(myInfo,myString,init)
# ---------- end act ----------

# ----
# 4- Human-Robot Interaction
# Notes: In this phase, human user can define interaction rules and start creating toolpaths via these rules. Please follow the steps below:
# 
# BEFORE INTERACTION:
# 1)It is important to check that all path names are changed (see in the pink notes): Path-0 (see in Part-1), Path-1 and Path-2 (see in Part-7), Path-3 (see in Part-10)
# 
# 2)Define interaction rules (Part-5).
# 
# 3)Run the python code (middleware) for real-time force feedback (either related to human or material).
# 
# 4)Before interacting with the robot, make sure that all recorded data is deleted and turned orange color.
# 
# 5)Start interactively creating toolpaths :)
# 
# AFTER INTERACTION:
# In order to preserve recorded toolpaths,
# 
# A)internalise the intermediatePLNS (see Part-2) by clicking on the component copy-paste, then right click on the copied component, select "Internalise data".
# 
# B)internalise the StructurallyRecPLNS(see Part-9) by clicking on the component, copy-paste (ctrl C, ctrl V), then right click on the copied component, select "Internalise data".
panel_10 = Panel(rec)
panel_11 = Panel(act)

# ----
# Send home position to the robot
kuka_crc = CoreKUKACrc(SimulationSlider=0, GetBooking=False, KUKACrcCmd=flatten(cmd), SendProgram=False)  # -> RobotGeometry, Booked, KUKACrcProg, KUKACrcProgLocal
upload = Button()
panel_12 = Panel(upload)
list_pub = ListPublisher(Topic="mcu-brh/cmd", Payloads=kuka_crc.KUKACrcProg, Publish=upload)

# ----
# 7- Replay of customized toolpaths
# EXPLANATION: Single_Trans: Takes the planes list (toolpath) and translates/moves the selected planes (idx) with selected distance (tx, ty, tz).
# 
# tx: distance along the X axis
# ty: distance along the Y axis
# tz: distance along the Z axis
# Remember: distance are in millimeters
number_slider_4 = Slider(1, range=0..7)
tz_3 = Slider(1, range=-100..100)
important = Panel("Test-11 - Use StructurallyRecPLN")
pln_8 = Plane()
single_trans_2 = GhPythonScript(myTree=pln_8, idx=number_slider_4, tx=Slider(0, range=-100..100), ty=Slider(0, range=-100..100), tz=tz_3)  # -> out, modifiedPLN; inputs myTree: tree of Plane, idx: Int32; same code as single_trans
pln_9 = Plane(single_trans_2.modifiedPLN)

explanation = Panel("Updated action planes")
waypoints = Plane(flatten(act))

# ----
# !!! IMPORTANT !!!: After interactively created the pattern, close python code. First, copy-paste (B) StructurallyRecPLNS, then right click on copied StructurallyRecPLNS, select "Internalise data".
# ***Part-9***
# Structurally Recorded Waypoints
# EXPLANATION: Rule generated action planes are collected in a tree structure (lists in a list).
trigger_2 = ListLength(List=intermediateplns_15)
python_14 = GhPythonScript(x=trigger_2)  # -> out, a; inputs x: Int32
# ---------- python_14: Python ----------
__author__ = "iremnurtokac"

import rhinoscriptsyntax as rs

if x == None:
    a=0
else:
    a=x
# ---------- end python_14 ----------
waypoints_2 = Data(waypoints)
path_3 = DataPath(python_14.a)
flatten = FlattenTree(Tree=waypoints_2, Path=path_3)
rec_7 = DataRecorder(flatten, DataLimit=-10, RecordData=True)
structurally_recorded_process = Panel(rec_7)

# ----
# *** Part-8 ***
# KUKA robot program
# EXPLANATION: This part gets the updated action planes (robotic movement definition) and converts this into KUKA robot program.
number_slider_5 = Slider(20, range=-180..180)
damping = Slider(50, range=0..100)
robot_name_2 = Panel("rhea")
crc_lin_move = LINearMovementKUKACrc(
    Device=robot_name_2,
    Target=waypoints,
    Redundancy=number_slider_5,
    Softness=Slider(10, range=0..100),
    Damping=damping,
    Speed=Slider(0.5, range=-180..180),
    Atype=0,
    Aparam=-1,
    Sync=False)
cmd_2 = Data(crc_lin_move)
kuka_crc_2 = CoreKUKACrc(SimulationSlider=0, GetBooking=False, KUKACrcCmd=flatten(cmd_2), SendProgram=False)  # -> RobotGeometry, Booked, KUKACrcProg, KUKACrcProgLocal

# ----
# ***Part-2***
# Customized toolpath
initial_pln_2 = Plane(Plane(origin=(-35.52, 649.38, 390.44), x=(0, 0.3421986111, -0.9396276446), y=(0.9965038929, -0.07850245391, -0.02858944269)))
entwine_2 = Entwine(Branch00=initial_pln_2, Branch01=pln_9, FlattenInputs=True)
gentoolpath_2 = Plane(entwine_2)

# ----
# ***Part-3***
# Robot program
number_slider_6 = Slider(10, range=-180..180)
damping_2 = Slider(50, range=0..100)
robot_name_3 = Panel("rhea")
pln_10 = Plane(flatten(gentoolpath_2))
crc_lin_move_2 = LINearMovementKUKACrc(
    Device=robot_name_3,
    Target=pln_10,
    Redundancy=number_slider_6,
    Softness=Slider(10, range=0..100),
    Damping=damping_2,
    Speed=Slider(0.5, range=-180..180),
    Atype=0,
    Aparam=-1,
    Sync=False)
cmd_3 = Data(crc_lin_move_2)
kuka_crc_3 = CoreKUKACrc(SimulationSlider=0, GetBooking=False, KUKACrcCmd=flatten(cmd_3), SendProgram=False)  # -> RobotGeometry, Booked, KUKACrcProg, KUKACrcProgLocal

# ---- group: B
structurallyrecpln_19 = Plane(rec_7)

# ----
# *** Part-10***
# Real-time feedback loop
# (Automated sending updated robot program)
# !!! IMPORTANT !!!: You should change the path, where you store myBoolean.tex
path_3_2 = FilePath("C:\Users\Iremnur\Desktop\ForceFeedback\myBoolean.txt")
panel_13 = Panel(path_3_2)
file_2 = ReadFile(File=path_3_2, PerLineParse=True)
list_pub_2 = ListPublisher(Topic="mcu-brh/cmd", Payloads=kuka_crc_2.KUKACrcProg, Publish=file_2)

# ----
# ***Part-4***
# Send replay to the robot
upload_2 = Button()
panel_14 = Panel(upload_2)
list_pub_3 = ListPublisher(Topic="mcu-brh/cmd", Payloads=kuka_crc_3.KUKACrcProg, Publish=upload_2)

# ----
# Action simulation
lbr14_r820_2 = IiwaLBR14R820Robot()
kmp_200_2 = KMP200MobilePlatformKUKAPrc(KUKAPrcRobotInput=lbr14_r820_2)
crc_prc_translator_2 = PRCTranslatorKUKACrc(KUKACrcCmd=cmd_2, KUKAPrcRobot=kmp_200_2)
kuka_prc_2 = KUKAPrcCORE(
    SimulationSlider=Slider(0, range=0..1),
    KUKAPrcCommands=crc_prc_translator_2,
    Robot=kmp_200_2,
    PRC_BaseExpose=False,
    PRC_SaveNameExpose=False,
    PRCsettings="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")  # -> RobotGeometry, AnalysisOutput

# ----
# ***Part-3***
# Robot program
number_slider_7 = Slider(10, range=-180..180)
damping_3 = Slider(50, range=0..100)
robot_name_4 = Panel("rhea")

# ----
# 5- Replay interactively created toolpaths
# Notes: In this phase, interactively generated toolpath is replayed. Please follow the steps below:
# 
# 1) Stop the python code (no real-time feedback in this phase).
# 
# 2) Plug-in the internalised (A) IntermediatePLNS and (B) StructurallyRecPLNS into "Generated Toolpath" component in Part-1.
# 
# 3) Copy-paste  "GenToolpath", right click on copied "GenToolpath", select "Internalise data".
# 
# 4) You can rename the internalised "GenToolpath" according to its corresponding pattern, e.g. Pattern-01 (see in Part-2).
# 
# 5) Plug-in this pattern toolpath into robot program (see in Part-3).
pln_11 = Plane(flatten(gentoolpath))

crc_lin_move_3 = LINearMovementKUKACrc(
    Device=robot_name_4,
    Target=pln_11,
    Redundancy=number_slider_7,
    Softness=Slider(10, range=0..100),
    Damping=damping_3,
    Speed=Slider(0.5, range=-180..180),
    Atype=0,
    Aparam=-1,
    Sync=False)
cmd_4 = Data(crc_lin_move_3)
kuka_crc_4 = CoreKUKACrc(SimulationSlider=0, GetBooking=False, KUKACrcCmd=flatten(cmd_4), SendProgram=False)  # -> RobotGeometry, Booked, KUKACrcProg, KUKACrcProgLocal

panel_15 = Panel(kuka_crc_4.KUKACrcProg)

# ----
# ***Part-4***
# Send replay to the robot
upload_3 = Button()
panel_16 = Panel(upload_3)
list_pub_4 = ListPublisher(Topic="mcu-brh/cmd", Payloads=kuka_crc_4.KUKACrcProg, Publish=upload_3)
